# Grasshopper definition 191028_ur_online_control_gh_group_03_is.gh (Grasshopper 1.0.7)

# layer height = 4
# for the mid size nozzle
panel = Panel("-181 bottom extruder")
panel_2 = Panel("-172")
number_slider = Slider(1, range=0..100)
number_slider_2 = Slider(3, range=0..100)
pt = ConstructPoint(XCoordinate=Slider(80, range=-100..100), YCoordinate=Slider(-170, range=-500..100), ZCoordinate="-20")

# ---- group: Robot
# 0a
# Settings
# Check your IP address and set UR IP address
server_address = ValueList({"192.168.10.2", "192.168.10.11", "127.0.0.1"}, selected="192.168.10.11")
ur_ip = ValueList({"192.168.10.13", "192.168.10.11", "192.168.10.10", "127.0.0.1"}, selected="192.168.10.13")
server_port = Integer(30003)
globals = PythonScript(server_address=server_address, server_port=server_port, ur_ip=ur_ip)  # inputs server_port: Int32
# ---------- globals: Python ----------
from scriptcontext import sticky as st

st["server_address"] = server_address
st["server_port"] = server_port

st["ur_ip"] = ur_ip
# ---------- end globals ----------

# Check if UR is available
ping = Button()
py = PythonScript(ip=ur_ip, ping=ping)  # -> out
# ---------- py: Python ----------
from scriptcontext import sticky as st
from mini_eggshell.ur_online_control.ur_direct.utilities import is_available


guid = str(ghenv.Component.InstanceGuid)
txt_key = "txt_" + guid
if txt_key not in st:
    st[txt_key] = ""

if ping:
    
    available = is_available(ip)
    
    if available:
        st[txt_key] = "%s is up!" % ip
    else:
        st[txt_key] = "%s is down!" % ip

print st[txt_key]
# ---------- end py ----------
panel_3 = Panel(py)

# ----
series = Series(Start=0, Step=number_slider_2, Count=number_slider)
Z = UnitZ(Factor=series)
cir = Circle(Plane=pt, Radius=Slider(65, range=0..100))
integer_division = IntegerDivision(A=number_slider_2, B=2)
range = Range(Domain=Domain(0, 1), Steps=number_slider)
move = Move(Geometry=cir, Motion=Z)  # -> Geometry, Transform

# ---- group: Robot
bang = Button()
panel_4 = Panel("Unload libraries")
# 1. load robot model
# 2. set tool
# 3. set basis
unload = PythonScript(bang=bang)
# ---------- unload: Python ----------
from compas_ghpython import unload_modules

unload_modules("compas")
unload_modules("ur_online_control")
# ---------- end unload ----------

# ----
graph = GraphMapper(range, x0=0, x1=1, y0=0, y1=1, container_name="Sine", Equation_px=[0, 1], Equation_py=[0.7653694153, 0.9405152202])
pipe = Pipe(Curve=move.Geometry, Radius=integer_division, Caps=1)  # -> flatten(Pipe)
area = Area(Geometry=move.Geometry)  # -> Area, Centroid
cap = CapHoles(Brep=pipe)

# ---- group: Robot
# 1. load robot model
# 2. set tool
# 3. set basis
list = ValueList({"no_tool": 0, "plastic_extruder": 1, "clay_extruder": 2, "clay_extruder_SS": 3}, selected="clay_extruder")
tools = Tools(tool_id=list)
base = PythonScript()  # -> base_frame, base
# ---------- base: Python ----------
from compas.geometry import Frame

"""
origin = [0, 0, 0]
xaxis = [1, 0, 0]
yaxis = [0, 1, 0]


origin = [-313.92, -147.58, 13.79]
xaxis = [0.00000, -1.00000, 0.00000]
yaxis = [1.00000, 0.00000, 0.00000]
"""

#axis    Y         Z                        X



#UR 10 floor setup

#origin = [-1140.17, 557.94, -396.35]
#xaxis = [0.00000, -1.00000, 0.00000]
#yaxis = [1.00000, 0.00000, 0.00000]


#UR 10 Table setup

origin = [-1048.97, 391.74, 80.43]
xaxis = [0.00000, -1.00000, 0.00116]
yaxis = [0.99997, -0.00001, -0.00809]


#UR 5 floor setup
 
#origin = [-706.51, -83.77, -478.98]
#xaxis = [1.00000, 0.00000, 0.00000]
#yaxis = [0.00000, 1.00000, 0.00003]


#UR5 base setup 
#origin = [164.22, 132.43, -23.59]
#xaxis = [0.97604, -0.21760, 0.00000]
#yaxis = [0.21760, 0.97604, 0.00000]

base_frame = Frame(list(origin), list(xaxis), list(yaxis))

base = "base = " + str(origin) + "\n"
# ---------- end base ----------
list_2 = ValueList({"UR5", "UR10"}, selected="UR10")
robot = PythonScript(model=list_2, tool=tools, base_frame=base.base_frame)  # -> robot
# ---------- robot: Python ----------
from mini_eggshell.ur_online_control.ur.ur10 import UR10
from mini_eggshell.ur_online_control.ur.ur5 import UR5
from scriptcontext import sticky as st

if model == "UR5":
    robot = UR5()
elif model == "UR10":
    robot = UR10()

if tool:
    robot.set_tool(tool)
if base_frame:
    robot.set_base(base_frame)

st["robot"] = robot
# ---------- end robot ----------

# ----
cull_i = CullIndex(List=graph, Indices=-1, Wrap=True)
scale = Scale(Geometry=move.Geometry, Center=area.Centroid, Factor=cull_i)  # -> Geometry, Transform

# ---- group: mm3 to Litres
volume = Volume(Geometry=cap)  # -> Volume, Centroid
multiplication = Multiplication(A=volume.Volume, B="0.000001")
ma = MassAddition(Input=multiplication)  # -> Result, PartialResults
panel_5 = Panel(ma.Result)

# ----
divide = DivideCurve(Curve=scale.Geometry, Count=Slider(12, range=0..100), Kinks=False)  # -> Points, Tangents, Parameters
panel_6 = Panel(base.base)
ur_5_tool_angle = Slider(80, range=0..100)

# ----
# 1_inner_circle
pt_2 = Point(Tree({0}: [Point(72, 300, 0), Point(70.66311895, 304.1144968, 0), Point(67.16311871, 306.6573957, 0), Point(62.83688109, 306.6573956, 0), Point(59.33688102, 304.1144967, 0), Point(58, 300, 0), Point(59.33688105, 295.8855032, 0), Point(62.83688129, 293.3426043, 0), Point(67.16311891, 293.3426044, 0), Point(70.66311898, 295.8855033, 0)], {1}: [Point(72, 300, 2.25), Point(70.66311895, 304.1144968, 2.25), Point(67.16311871, 306.6573957, 2.25), Point(62.83688109, 306.6573956, 2.25), Point(59.33688102, 304.1144967, 2.25), Point(58, 300, 2.25), Point(59.33688105, 295.8855032, 2.25), Point(62.83688129, 293.3426043, 2.25), Point(67.16311891, 293.3426044, 2.25), Point(70.66311898, 295.8855033, 2.25)], {2}: [Point(72, 300, 4.5), Point(70.66311895, 304.1144968, 4.5), Point(67.16311871, 306.6573957, 4.5), Point(62.83688109, 306.6573956, 4.5), Point(59.33688102, 304.1144967, 4.5), Point(58, 300, 4.5), Point(59.33688105, 295.8855032, 4.5), Point(62.83688129, 293.3426043, 4.5), Point(67.16311891, 293.3426044, 4.5), Point(70.66311898, 295.8855033, 4.5)], {3}: [Point(72, 300, 6.75), Point(70.66311895, 304.1144968, 6.75), Point(67.16311871, 306.6573957, 6.75), Point(62.83688109, 306.6573956, 6.75), Point(59.33688102, 304.1144967, 6.75), Point(58, 300, 6.75), Point(59.33688105, 295.8855032, 6.75), Point(62.83688129, 293.3426043, 6.75), Point(67.16311891, 293.3426044, 6.75), Point(70.66311898, 295.8855033, 6.75)], {4}: [Point(72, 300, 9), Point(70.66311895, 304.1144968, 9), Point(67.16311871, 306.6573957, 9), Point(62.83688109, 306.6573956, 9), Point(59.33688102, 304.1144967, 9), Point(58, 300, 9), Point(59.33688105, 295.8855032, 9), Point(62.83688129, 293.3426043, 9), Point(67.16311891, 293.3426044, 9), Point(70.66311898, 295.8855033, 9)], {5}: [Point(72, 300, 11.25), Point(70.66311895, 304.1144968, 11.25), Point(67.16311871, 306.6573957, 11.25), Point(62.83688109, 306.6573956, 11.25), Point(59.33688102, 304.1144967, 11.25), Point(58, 300, 11.25), Point(59.33688105, 295.8855032, 11.25), Point(62.83688129, 293.3426043, 11.25), Point(67.16311891, 293.3426044, 11.25), Point(70.66311898, 295.8855033, 11.25)]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))  # disabled
number_slider_3 = Slider(5, range=0..10)  # disabled
# 1st Attemp
# 4.5
tstat = TreeStatistics(Tree=pt_2)  # -> Paths, Length, Count; disabled
item = ListItem(List=tstat.Length, Index=0, Wrap=True)  # disabled
multiplication_2 = Multiplication(A=item, B=number_slider_3)  # disabled
number_slider_4 = Slider(0, range=0..11)  # disabled
partition = PartitionList(List=flatten(pt_2), Size=multiplication_2)  # disabled
branch = TreeBranch(Tree=simplify(partition), Path=number_slider_4, MaintainPaths=True)  # disabled
md_slider = MDSlider(
    SliderMode=0,
    slider_value=Point(0.3176686357, 0.4964048804, 0.5),
    x_domain=Domain(0, 490),
    y_domain=Domain(0, 490),
    z_domain=Domain(0, 1))  # disabled
panel_7 = Panel("490")  # disabled
rectangle = Rectangle(Plane=PlaneXY(0, 0, 0), XSize=panel_7, YSize=panel_7, Radius=0)  # -> Rectangle, Length; disabled
pt_3 = Point(branch)  # disabled
pt_4 = Point(Point(40, 175, 0))  # disabled
orient = Orient(Geometry=pt_3, Source=pt_4, Target=md_slider)  # -> Geometry, Transform; disabled

# ----
# 2_outer_shell
pt_5 = Point(Tree({0}: [Point(100.9040267, 298.1922049, 0), Point(108.689017, 306.5965234, 0), Point(120.0771981, 307.7954899, 0), Point(127.8709132, 316.1823612, 0), Point(132.1896912, 324.3520996, 0), Point(127.6195481, 335.0748723, 0)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], {1}: [Point(99.13239165, 301.8449454, 2.25), Point(110.5433633, 302.9758048, 2.25), Point(118.286, 311.4153123, 2.25), Point(129.6686347, 312.6026292, 2.25), Point(127.2393287, 324.3005889, 2.25), Point(131.3296563, 335.2079799, 2.25)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], {2}: [Point(101.1880442, 298.1199777, 4.5), Point(108.8075119, 306.6711262, 4.5), Point(120.1815001, 307.8140834, 4.5), Point(127.8469328, 316.2745367, 4.5), Point(131.1106493, 324.7125091, 4.5), Point(125.5668785, 334.9340781, 4.5)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], {3}: [Point(99.54682999, 301.9119011, 6.75), Point(110.9152409, 302.9773907, 6.75), Point(118.4223482, 311.5410034, 6.75), Point(129.7287569, 312.7268928, 6.75), Point(125.8943325, 324.4319369, 6.75), Point(129.2736926, 335.5187276, 6.75)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], {4}: [Point(101.9668827, 298.0607545, 9), Point(109.2450882, 306.7877657, 9), Point(120.511991, 307.942485, 9), Point(127.7931051, 316.6639742, 9), Point(129.7189515, 325.3491318, 9), Point(123.4150745, 335.0109628, 9)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], {5}: [Point(100.4091386, 301.9605536, 11.25), Point(111.6468675, 303.0568102, 11.25), Point(118.7474929, 311.777267, 11.25), Point(130.6961457, 315.550419, 11.25), Point(124.1732563, 324.9402683, 11.25), Point(127.0762998, 336.0333956, 11.25)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]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))  # disabled
tstat_2 = TreeStatistics(Tree=pt_5)  # -> Paths, Length, Count; disabled
item_2 = ListItem(List=tstat_2.Length, Index=0, Wrap=True)  # disabled
multiplication_3 = Multiplication(A=item_2, B=number_slider_3)  # disabled
partition_2 = PartitionList(List=flatten(pt_5), Size=multiplication_3)  # disabled
branch_2 = TreeBranch(Tree=simplify(partition_2), Path=number_slider_4, MaintainPaths=True)  # disabled
panel_8 = Panel("490")  # disabled
rectangle_2 = Rectangle(Plane=PlaneXY(0, 0, 0), XSize=panel_8, YSize=panel_8, Radius=0)  # -> Rectangle, Length; disabled
pt_6 = Point(branch_2)  # disabled
pt_7 = Point(Point(40, 175, 0))  # disabled
orient_2 = Orient(Geometry=pt_6, Source=pt_7, Target=md_slider)  # -> Geometry, Transform; disabled

point = Point()

# ---- group: Fabrication planes
pln = Plane(flatten(divide.Points))

# ----
# PLANE ROTATION
ur_10_tool_angle = Slider(90, range=0..100)
number_slider_5 = Slider(0, range=0..1000)

number_slider_6 = Slider(490, range=0..1000)
point_2 = Point("0,0,100")
point_3 = Point("0,0,0")
xy_plane = XYPlane(Origin=point_2)
xy_plane_2 = XYPlane(Origin=point_3)

# ---- group: test_pt
pt_8 = Point(Point(143.5449512, 26.81423755, 319.3127676))
xy = XYPlane(Origin=pt_8)
rotate = Rotate(Geometry=xy, Angle=degrees(ur_10_tool_angle), Plane=xy)  # -> Geometry, Transform

# ---- group: filament_loading_pt
pt_9 = Point(Point(7.266607641, 97.95218925, 356.2487973))
xy_2 = XYPlane(Origin=pt_9)
rotate_2 = Rotate(Geometry=xy_2, Angle=degrees(ur_10_tool_angle), Plane=xy_2)  # -> Geometry, Transform

# ----
# 1_inner_circle
panel_9 = Panel("490")  # disabled
pt_10 = Point(flatten([Point(72, 300, 135), Point(70.66311895, 304.1144968, 135), Point(67.16311871, 306.6573957, 135), Point(62.83688109, 306.6573956, 135), Point(59.33688102, 304.1144967, 135), Point(58, 300, 135)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]))  # disabled
rectangle_3 = Rectangle(Plane=PlaneXY(0, 0, 0), XSize=panel_9, YSize=panel_9, Radius=0)  # -> Rectangle, Length; disabled
pt_11 = Point(Point(40, 175, 0))  # disabled
orient_3 = Orient(Geometry=pt_10, Source=pt_11, Target=md_slider)  # -> Geometry, Transform; disabled

# ----
# 2_outer_shell
panel_10 = Panel("490")  # disabled
pt_12 = Point(flatten([Point(128, 300, 135), Point(132, 302.6892379, 135), Point(128, 305.3784759, 135), Point(132, 308.0677138, 135), Point(128, 310.7569517, 135), Point(132, 313.4461897, 135)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]))  # disabled
rectangle_4 = Rectangle(Plane=PlaneXY(0, 0, 0), XSize=panel_10, YSize=panel_10, Radius=0)  # -> Rectangle, Length; disabled
pt_13 = Point(Point(40, 175, 0))  # disabled
orient_4 = Orient(Geometry=pt_12, Source=pt_13, Target=md_slider)  # -> Geometry, Transform; disabled

rectangle_5 = Rectangle(Plane=xy_plane_2, XSize=number_slider_6, YSize=number_slider_6, Radius=0)  # -> Rectangle, Length
number_slider_7 = Slider(0, range=0..1000)
surface = Surface(rectangle_5.Rectangle)
santos = Panel("python C:\Users\indra\Documents\GIT\mini_eggshell\ur_online_control\communication\main_direct_send_group_03.py")

# ----
# 1_inner_circle
pt_14 = Point(Tree({0}: [Point(72, 300, 0), Point(70.66311895, 304.1144968, 0), Point(67.16311871, 306.6573957, 0), Point(62.83688109, 306.6573956, 0), Point(59.33688102, 304.1144967, 0), Point(58, 300, 0), Point(59.33688105, 295.8855032, 0), Point(62.83688129, 293.3426043, 0), Point(67.16311891, 293.3426044, 0), Point(70.66311898, 295.8855033, 0)], {1}: [Point(72, 300, 2.5), Point(70.66311895, 304.1144968, 2.5), Point(67.16311871, 306.6573957, 2.5), Point(62.83688109, 306.6573956, 2.5), Point(59.33688102, 304.1144967, 2.5), Point(58, 300, 2.5), Point(59.33688105, 295.8855032, 2.5), Point(62.83688129, 293.3426043, 2.5), Point(67.16311891, 293.3426044, 2.5), Point(70.66311898, 295.8855033, 2.5)], {2}: [Point(72, 300, 5), Point(70.66311895, 304.1144968, 5), Point(67.16311871, 306.6573957, 5), Point(62.83688109, 306.6573956, 5), Point(59.33688102, 304.1144967, 5), Point(58, 300, 5), Point(59.33688105, 295.8855032, 5), Point(62.83688129, 293.3426043, 5), Point(67.16311891, 293.3426044, 5), Point(70.66311898, 295.8855033, 5)], {3}: [Point(72, 300, 7.5), Point(70.66311895, 304.1144968, 7.5), Point(67.16311871, 306.6573957, 7.5), Point(62.83688109, 306.6573956, 7.5), Point(59.33688102, 304.1144967, 7.5), Point(58, 300, 7.5), Point(59.33688105, 295.8855032, 7.5), Point(62.83688129, 293.3426043, 7.5), Point(67.16311891, 293.3426044, 7.5), Point(70.66311898, 295.8855033, 7.5)], {4}: [Point(72, 300, 10), Point(70.66311895, 304.1144968, 10), Point(67.16311871, 306.6573957, 10), Point(62.83688109, 306.6573956, 10), Point(59.33688102, 304.1144967, 10), Point(58, 300, 10), Point(59.33688105, 295.8855032, 10), Point(62.83688129, 293.3426043, 10), Point(67.16311891, 293.3426044, 10), Point(70.66311898, 295.8855033, 10)], {5}: [Point(72, 300, 12.5), Point(70.66311895, 304.1144968, 12.5), Point(67.16311871, 306.6573957, 12.5), Point(62.83688109, 306.6573956, 12.5), Point(59.33688102, 304.1144967, 12.5), Point(58, 300, 12.5), Point(59.33688105, 295.8855032, 12.5), Point(62.83688129, 293.3426043, 12.5), Point(67.16311891, 293.3426044, 12.5), Point(70.66311898, 295.8855033, 12.5)]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))  # disabled
number_slider_8 = Slider(5, range=0..10)  # disabled
# 2nd Attemp
# 5
tstat_3 = TreeStatistics(Tree=pt_14)  # -> Paths, Length, Count; disabled
item_3 = ListItem(List=tstat_3.Length, Index=0, Wrap=True)  # disabled
multiplication_4 = Multiplication(A=item_3, B=number_slider_8)  # disabled
number_slider_9 = Slider(0, range=0..11)  # disabled
partition_3 = PartitionList(List=flatten(pt_14), Size=multiplication_4)  # disabled
branch_3 = TreeBranch(Tree=simplify(partition_3), Path=number_slider_9, MaintainPaths=True)  # disabled
md_slider_2 = MDSlider(
    SliderMode=0,
    slider_value=Point(0.6688024009, 0.491711128, 0.5),
    x_domain=Domain(0, 490),
    y_domain=Domain(0, 490),
    z_domain=Domain(0, 1))  # disabled
panel_11 = Panel("490")  # disabled
rectangle_6 = Rectangle(Plane=PlaneXY(0, 0, 0), XSize=panel_11, YSize=panel_11, Radius=0)  # -> Rectangle, Length; disabled
pt_15 = Point(Point(40, 175, 0))  # disabled
pt_16 = Point(branch_3)  # disabled
orient_5 = Orient(Geometry=pt_16, Source=pt_15, Target=md_slider_2)  # -> Geometry, Transform; disabled

# ----
# 2_outer_shell
pt_17 = Point(Tree({0}: [Point(100.9040267, 298.1922049, 0), Point(108.689017, 306.5965234, 0), Point(120.0771981, 307.7954899, 0), Point(127.8709132, 316.1823612, 0), Point(132.1896912, 324.3520996, 0), Point(127.6195481, 335.0748723, 0)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], {1}: [Point(99.13239165, 301.8449454, 2.5), Point(110.5433633, 302.9758048, 2.5), Point(118.286, 311.4153123, 2.5), Point(129.6686347, 312.6026292, 2.5), Point(127.2393287, 324.3005889, 2.5), Point(131.3296563, 335.2079799, 2.5)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], {2}: [Point(101.1880442, 298.1199777, 5), Point(108.8075119, 306.6711262, 5), Point(120.1815001, 307.8140834, 5), Point(127.8469328, 316.2745367, 5), Point(131.1106493, 324.7125091, 5), Point(125.5668785, 334.9340781, 5)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], {3}: [Point(99.54682999, 301.9119011, 7.5), Point(110.9152409, 302.9773907, 7.5), Point(118.4223482, 311.5410034, 7.5), Point(129.7287569, 312.7268928, 7.5), Point(125.8943325, 324.4319369, 7.5), Point(129.2736926, 335.5187276, 7.5)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], {4}: [Point(101.9668827, 298.0607545, 10), Point(109.2450882, 306.7877657, 10), Point(120.511991, 307.942485, 10), Point(127.7931051, 316.6639742, 10), Point(129.7189515, 325.3491318, 10), Point(123.4150745, 335.0109628, 10)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], {5}: [Point(100.4091386, 301.9605536, 12.5), Point(111.6468675, 303.0568102, 12.5), Point(118.7474929, 311.777267, 12.5), Point(130.6961457, 315.550419, 12.5), Point(124.1732563, 324.9402683, 12.5), Point(127.0762998, 336.0333956, 12.5)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]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))  # disabled
tstat_4 = TreeStatistics(Tree=pt_17)  # -> Paths, Length, Count; disabled
item_4 = ListItem(List=tstat_4.Length, Index=0, Wrap=True)  # disabled
multiplication_5 = Multiplication(A=item_4, B=number_slider_8)  # disabled
partition_4 = PartitionList(List=flatten(pt_17), Size=multiplication_5)  # disabled
branch_4 = TreeBranch(Tree=simplify(partition_4), Path=number_slider_9, MaintainPaths=True)  # disabled
panel_12 = Panel("490")  # disabled
rectangle_7 = Rectangle(Plane=PlaneXY(0, 0, 0), XSize=panel_12, YSize=panel_12, Radius=0)  # -> Rectangle, Length; disabled
pt_18 = Point(branch_4)  # disabled
pt_19 = Point(Point(40, 175, 0))  # disabled
orient_6 = Orient(Geometry=pt_18, Source=pt_19, Target=md_slider_2)  # -> Geometry, Transform; disabled

# ----
# 1_inner_circle
panel_13 = Panel("490")  # disabled
pt_20 = Point(flatten([Point(72, 300, 150), Point(70.66311895, 304.1144968, 150), Point(67.16311871, 306.6573957, 150), Point(62.83688109, 306.6573956, 150), Point(59.33688102, 304.1144967, 150), Point(58, 300, 150)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]))  # disabled
rectangle_8 = Rectangle(Plane=PlaneXY(0, 0, 0), XSize=panel_13, YSize=panel_13, Radius=0)  # -> Rectangle, Length; disabled
pt_21 = Point(Point(40, 175, 0))  # disabled
orient_7 = Orient(Geometry=pt_20, Source=pt_21, Target=md_slider_2)  # -> Geometry, Transform; disabled

# ----
# 2_outer_shell
panel_14 = Panel("490")  # disabled
pt_22 = Point(flatten([Point(128, 300, 150), Point(132, 302.6892379, 150), Point(128, 305.3784759, 150), Point(132, 308.0677138, 150), Point(128, 310.7569517, 150), Point(132, 313.4461897, 150)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]))  # disabled
rectangle_9 = Rectangle(Plane=PlaneXY(0, 0, 0), XSize=panel_14, YSize=panel_14, Radius=0)  # -> Rectangle, Length; disabled
pt_23 = Point(Point(40, 175, 0))  # disabled
orient_8 = Orient(Geometry=pt_22, Source=pt_23, Target=md_slider_2)  # -> Geometry, Transform; disabled

# ----
# Direct UR control
get = Button()
get_2 = Button()
pose = PythonScript(get=get_2)  # -> pose_joints
# ---------- pose: Python ----------
from scriptcontext import sticky as st
from mini_eggshell.ur_online_control.ur_direct import get_current_pose_joints
from mini_eggshell.ur_online_control.ur.robot import BaseConfiguration

server_address = st["server_address"]
server_port = 30005
ur_ip = st["ur_ip"]
robot = st["robot"]
tool_angle_axis = list(robot.tool.tcp_frame.point) + list(robot.tool.tcp_frame.axis_angle_vector)
print tool_angle_axis

guid = str(ghenv.Component.InstanceGuid)
pose_joints_key = "pose_joints" + guid

if get:
    st[pose_joints_key] = get_current_pose_joints(server_address, server_port, ur_ip, tool_angle_axis)
    
if pose_joints_key not in st:
    pose_joints = []
else:
    pose_joints = BaseConfiguration.from_joints(st[pose_joints_key])
# ---------- end pose ----------
pose_2 = PythonScript(get=get)  # -> pose_cartesian
# ---------- pose_2: Python ----------
from scriptcontext import sticky as st
from mini_eggshell.ur_online_control.ur_direct import get_current_pose_cartesian

server_address = st["server_address"]
server_port = 30005
ur_ip = st["ur_ip"]
robot = st["robot"]

tool_angle_axis = list(robot.tool.tcp_frame.point) + robot.tool.tcp_frame.axis_angle_vector
print tool_angle_axis

guid = str(ghenv.Component.InstanceGuid)
pose_cartesian_key = "pose_cartesian" + guid


if get:
    st[pose_cartesian_key] = get_current_pose_cartesian(server_address, server_port, ur_ip, tool_angle_axis)

if pose_cartesian_key not in st:
    pose_cartesian = []
else:
    pose_cartesian = st[pose_cartesian_key]
# ---------- end pose_2 ----------
stop = Button()
stop_2 = PythonScript(stop=stop)
# ---------- stop_2: Python ----------
from scriptcontext import sticky as st
from mini_eggshell.ur_online_control.ur_direct import stop as stop_robot

ur_ip = st["ur_ip"]

if stop:
    stop_robot(ur_ip)
# ---------- end stop_2 ----------
panel_15 = Panel(pose)
panel_16 = Panel(pose_2)

# ----
# 0b
vertical_pose = Number([-152.427, -780.635, 855.229, -1.1958, -1.22046, -1.20201])
back = Button()
reset = Button()

# ---- group: Define joint positions
base_2 = Slider(90.163, range=-360..360)
shoulder = Slider(0, range=-360..360)
elbow = Slider(-102.857, range=-360..360)
wrist1 = Slider(0, range=-360..360)
wrist2 = Slider(0, range=-360..360)
wrist3 = Slider(0, range=-360..360)
ur1_q1_q6 = Data([base_2, shoulder, elbow, wrist1, wrist2, wrist3])

# ----
# Measure basis:
# 1. Clear the recorded poses
# 2. Move robot to origin and press "get pose"
# 3. Move robot to point in positive x-axis and press "get pose"
# 4. Move robot to an other point in your basis and press "get pose"
# (The farer away these positions are, the better)
# 
# 5. Alternatively change the order in the component calc base
# 6. Copy output into base component
# Calculate basis
list_3 = ValueList({"origin, pt on positive x-axis, pt in xy plane": 0, "origin, pt on positive y-axis, pt in xy plane": 1}, selected="origin, pt on positive x-axis, pt in xy plane")
clear = Button()
rec = PythonScript(msg=pose_2, rec=get, clear=clear)  # -> rec; inputs msg: list
# ---------- rec: Python ----------
from scriptcontext import sticky as st

guid = str(ghenv.Component.InstanceGuid)
recorded_key =  "recorded_" + guid
just_cleared_key = "just_cleared_" + guid

if recorded_key not in st:
    st[recorded_key] = []

if just_cleared_key not in st:
    st[just_cleared_key] = False

if clear:
    st[recorded_key] = []
    st[just_cleared_key] = True
else:
    if len(msg):
        if msg != [None] and not st[just_cleared_key] and rec:
            st[recorded_key].append(msg)
    st[just_cleared_key] = False
        


rec = st[recorded_key]

print rec
# ---------- end rec ----------
calc_base = PythonScript(poses=rec, input_type=list_3)  # -> out; inputs poses: list
# ---------- calc_base: Python ----------
import Rhino.Geometry as rg
import math


if len(poses) > 2:
    
    O = poses[0]
    P1 = poses[1]
    P2 = poses[2]
    
    if input_type == 0:
        # origin, pt on positive x-axis, pt in xy plane
        origin = rg.Point3d(O[0], O[1], O[2])
        pt_on_xaxis = rg.Point3d(P1[0], P1[1], P1[2])
        pt_in_xyplane = rg.Point3d(P2[0], P2[1], P2[2])
        
        xaxis = pt_on_xaxis - origin
        xaxis.Unitize()
        
        v = pt_in_xyplane - origin
        zaxis = rg.Vector3d.CrossProduct(v, xaxis)
        zaxis.Unitize()
        
        # zaxis must look up!
        if math.acos(rg.Vector3d.ZAxis * zaxis) > math.acos(rg.Vector3d.ZAxis * -zaxis):
            zaxis = -zaxis
        
        yaxis = rg.Vector3d.CrossProduct(zaxis, xaxis)
    
    elif input_type == 1:
        # origin, pt on positive y-axis, pt in xy plane
        origin = rg.Point3d(O[0], O[1], O[2])
        pt_on_yaxis = rg.Point3d(P1[0], P1[1], P1[2])
        pt_in_xyplane = rg.Point3d(P2[0], P2[1], P2[2])
        
        yaxis = pt_on_yaxis - origin
        yaxis.Unitize()
        
        v = pt_in_xyplane - origin
        zaxis = rg.Vector3d.CrossProduct(v, yaxis)
        zaxis.Unitize()
        
        # zaxis must look up!
        if math.acos(rg.Vector3d.ZAxis * zaxis) > math.acos(rg.Vector3d.ZAxis * -zaxis):
            zaxis = -zaxis
        
        xaxis = rg.Vector3d.CrossProduct(yaxis, zaxis)
        
        
    print "Copy the following into base component:"
    print " "
    print "origin = [%.2f, %.2f, %.2f]" % tuple(list(origin))
    print "xaxis = [%.5f, %.5f, %.5f]" % tuple(list(xaxis))
    print "yaxis = [%.5f, %.5f, %.5f]" % tuple(list(yaxis))
    

#print rg.Vector3d.CrossProduct(rg.Vector3d.YAxis, rg.Vector3d.ZAxis)
#print rg.Vector3d.CrossProduct(rg.Vector3d.ZAxis, rg.Vector3d.XAxis)
# ---------- end calc_base ----------
panel_17 = Panel(rec)
panel_18 = Panel(calc_base)

py_2 = GhPythonScript(joint_values=ur1_q1_q6)  # -> configuration; inputs joint_values: list
# ---------- py_2: Python ----------
import math
from ur_online_control.ur.robot import BaseConfiguration

configuration = BaseConfiguration.from_joints([math.radians(d) for d in joint_values])
# ---------- end py_2 ----------

pt_24 = Point(Tree({0}: [Point(72, 300, 0), Point(70.66311895, 304.1144968, 0), Point(67.16311871, 306.6573957, 0), Point(62.83688109, 306.6573956, 0), Point(59.33688102, 304.1144967, 0), Point(58, 300, 0), Point(59.33688105, 295.8855032, 0), Point(62.83688129, 293.3426043, 0), Point(67.16311891, 293.3426044, 0), Point(70.66311898, 295.8855033, 0)], {1}: [Point(72, 300, 2.5), Point(70.66311895, 304.1144968, 2.5), Point(67.16311871, 306.6573957, 2.5), Point(62.83688109, 306.6573956, 2.5), Point(59.33688102, 304.1144967, 2.5), Point(58, 300, 2.5), Point(59.33688105, 295.8855032, 2.5), Point(62.83688129, 293.3426043, 2.5), Point(67.16311891, 293.3426044, 2.5), Point(70.66311898, 295.8855033, 2.5)], {2}: [Point(72, 300, 5), Point(70.66311895, 304.1144968, 5), Point(67.16311871, 306.6573957, 5), Point(62.83688109, 306.6573956, 5), Point(59.33688102, 304.1144967, 5), Point(58, 300, 5), Point(59.33688105, 295.8855032, 5), Point(62.83688129, 293.3426043, 5), Point(67.16311891, 293.3426044, 5), Point(70.66311898, 295.8855033, 5)], {3}: [Point(72, 300, 7.5), Point(70.66311895, 304.1144968, 7.5), Point(67.16311871, 306.6573957, 7.5), Point(62.83688109, 306.6573956, 7.5), Point(59.33688102, 304.1144967, 7.5), Point(58, 300, 7.5), Point(59.33688105, 295.8855032, 7.5), Point(62.83688129, 293.3426043, 7.5), Point(67.16311891, 293.3426044, 7.5), Point(70.66311898, 295.8855033, 7.5)], {4}: [Point(72, 300, 10), Point(70.66311895, 304.1144968, 10), Point(67.16311871, 306.6573957, 10), Point(62.83688109, 306.6573956, 10), Point(59.33688102, 304.1144967, 10), Point(58, 300, 10), Point(59.33688105, 295.8855032, 10), Point(62.83688129, 293.3426043, 10), Point(67.16311891, 293.3426044, 10), Point(70.66311898, 295.8855033, 10)], {5}: [Point(72, 300, 12.5), Point(70.66311895, 304.1144968, 12.5), Point(67.16311871, 306.6573957, 12.5), Point(62.83688109, 306.6573956, 12.5), Point(59.33688102, 304.1144967, 12.5), Point(58, 300, 12.5), Point(59.33688105, 295.8855032, 12.5), Point(62.83688129, 293.3426043, 12.5), Point(67.16311891, 293.3426044, 12.5), Point(70.66311898, 295.8855033, 12.5)]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))
number_slider_10 = Slider(5, range=0..10)
tstat_5 = TreeStatistics(Tree=pt_24)  # -> Paths, Length, Count
item_5 = ListItem(List=tstat_5.Length, Index=0, Wrap=True)
multiplication_6 = Multiplication(A=item_5, B=number_slider_10)
number_slider_11 = Slider(11, range=0..11)
partition_5 = PartitionList(List=flatten(pt_24), Size=multiplication_6)
branch_5 = TreeBranch(Tree=simplify(partition_5), Path=number_slider_11, MaintainPaths=True)
md_slider_3 = MDSlider(
    SliderMode=0,
    slider_value=Point(0.3176686357, 0.4964048804, 0.5),
    x_domain=Domain(0, 490),
    y_domain=Domain(0, 490),
    z_domain=Domain(0, 1))
rectangle_10 = Rectangle(Plane=PlaneXY(0, 0, 0), XSize="490", YSize="490", Radius=0)  # -> Rectangle, Length
pt_25 = Point(branch_5)
pt_26 = Point(Point(40, 175, 0))
orient_9 = Orient(Geometry=pt_25, Source=pt_26, Target=md_slider_3)  # -> Geometry, Transform

pt_27 = Point(Tree({0}: [Point(100.9087754, 298.1827089, 0), Point(108.6859643, 306.602628, 0), Point(120.0788806, 307.7921254, 0), Point(127.8691568, 316.1858736, 0), Point(132.287586, 324.3520801, 0), Point(127.4313045, 335.0749098, 0)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], {1}: [Point(99.11797063, 301.8736773, 2.5), Point(110.5531839, 302.9562385, 2.5), Point(118.2802298, 311.4268087, 2.5), Point(129.6729377, 312.5940561, 2.5), Point(127.1289899, 324.2954608, 2.5), Point(131.5151457, 335.2166006, 2.5)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], {2}: [Point(101.2123839, 298.071952, 5), Point(108.7904852, 306.7047224, 5), Point(120.1921105, 307.7931476, 5), Point(127.8391591, 316.2898753, 5), Point(131.2392037, 324.7236521, 5), Point(125.3764443, 334.9175713, 5)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], {3}: [Point(99.51237335, 301.9788112, 7.5), Point(110.9397343, 302.9298278, 7.5), Point(118.4064543, 311.5718672, 7.5), Point(129.740812, 312.7034836, 7.5), Point(125.7450375, 324.4136857, 7.5), Point(129.4716763, 335.542931, 7.5)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], {4}: [Point(102.011584, 297.9758919, 10), Point(109.213048, 306.8485919, 10), Point(120.5333718, 307.9018948, 10), Point(127.7391988, 316.7663119, 10), Point(129.8898424, 325.3753724, 10), Point(123.2081707, 334.9791923, 10)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], {5}: [Point(100.3541493, 302.0618925, 12.5), Point(111.6863445, 302.9840587, 12.5), Point(118.7206293, 311.8267734, 12.5), Point(130.8729029, 315.5823593, 12.5), Point(123.9813754, 324.9055952, 12.5), Point(127.2924962, 336.0724625, 12.5)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]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))
tstat_6 = TreeStatistics(Tree=pt_27)  # -> Paths, Length, Count
item_6 = ListItem(List=tstat_6.Length, Index=0, Wrap=True)
multiplication_7 = Multiplication(A=item_6, B=number_slider_10)
partition_6 = PartitionList(List=flatten(pt_27), Size=multiplication_7)
branch_6 = TreeBranch(Tree=simplify(partition_6), Path=number_slider_11, MaintainPaths=True)
rectangle_11 = Rectangle(Plane=PlaneXY(0, 0, 0), XSize="490", YSize="490", Radius=0)  # -> Rectangle, Length
pt_28 = Point(branch_6)
pt_29 = Point(Point(40, 175, 0))
orient_10 = Orient(Geometry=pt_28, Source=pt_29, Target=md_slider_3)  # -> Geometry, Transform

# ---- group: Visualise / robot model brep
py_3 = PythonScript(model=list_2)  # -> n
# ---------- py_3: Python ----------
if model == "UR5":
    n = 0
if model == "UR10":
    n = 1

print n
# ---------- end py_3 ----------
ur10_brep = UR10Brep([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])
ur5_brep = UR5Brep([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])
show_brep = BooleanToggle(False)
filter = StreamFilter(Gate=py_3, Stream0=ur5_brep, Stream1=ur10_brep)

# ----
panel_19 = Panel("""33
34""")

pt_30 = Point(Tree({0}: [Point(100.9087754, 298.1827089, 0), Point(108.6859643, 306.602628, 0), Point(120.0788806, 307.7921254, 0), Point(127.8691568, 316.1858736, 0), Point(132.287586, 324.3520801, 0), Point(127.4313045, 335.0749098, 0)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], {1}: [Point(99.11797063, 301.8736773, 2.5), Point(110.5531839, 302.9562385, 2.5), Point(118.2802298, 311.4268087, 2.5), Point(129.6729377, 312.5940561, 2.5), Point(127.1289899, 324.2954608, 2.5), Point(131.5151457, 335.2166006, 2.5)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], {2}: [Point(101.2123839, 298.071952, 5), Point(108.7904852, 306.7047224, 5), Point(120.1921105, 307.7931476, 5), Point(127.8391591, 316.2898753, 5), Point(131.2392037, 324.7236521, 5), Point(125.3764443, 334.9175713, 5)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], {3}: [Point(99.51237335, 301.9788112, 7.5), Point(110.9397343, 302.9298278, 7.5), Point(118.4064543, 311.5718672, 7.5), Point(129.740812, 312.7034836, 7.5), Point(125.7450375, 324.4136857, 7.5), Point(129.4716763, 335.542931, 7.5)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], {4}: [Point(102.011584, 297.9758919, 10), Point(109.213048, 306.8485919, 10), Point(120.5333718, 307.9018948, 10), Point(127.7391988, 316.7663119, 10), Point(129.8898424, 325.3753724, 10), Point(123.2081707, 334.9791923, 10)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], {5}: [Point(100.3541493, 302.0618925, 12.5), Point(111.6863445, 302.9840587, 12.5), Point(118.7206293, 311.8267734, 12.5), Point(130.8729029, 315.5823593, 12.5), Point(123.9813754, 324.9055952, 12.5), Point(127.2924962, 336.0724625, 12.5)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]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))
tstat_7 = TreeStatistics(Tree=pt_30)  # -> Paths, Length, Count
item_7 = ListItem(List=tstat_7.Length, Index=0, Wrap=True)
multiplication_8 = Multiplication(A=item_7)
partition_7 = PartitionList(List=flatten(pt_30), Size=multiplication_8)
branch_7 = TreeBranch(Tree=simplify(partition_7), Path=panel_19, MaintainPaths=True)
pt_31 = Point(flatten(branch_7))
rectangle_12 = Rectangle(Plane=PlaneXY(0, 0, 0), XSize="490", YSize="490", Radius=0)  # -> Rectangle, Length
pt_32 = Point(Point(40, 175, 0))
orient_11 = Orient(Geometry=pt_31, Source=pt_32, Target=md_slider_3)  # -> Geometry, Transform

# ----
# SEQUENCE CONTROLLER
value_list = ValueList({"Sequence 1": 0, "Sequence 2": 1, "Sequence 3": 2, "Sequence 4": 3}, selected="Sequence 2")
stream_filter = StreamFilter(Gate=value_list)

pt_33 = Point(flatten([Point(72, 300, 150), Point(70.66311895, 304.1144968, 150), Point(67.16311871, 306.6573957, 150), Point(62.83688109, 306.6573956, 150), Point(59.33688102, 304.1144967, 150), Point(58, 300, 150)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]))
rectangle_13 = Rectangle(Plane=PlaneXY(0, 0, 0), XSize="490", YSize="490", Radius=0)  # -> Rectangle, Length
pt_34 = Point(Point(40, 175, 0))
orient_12 = Orient(Geometry=pt_33, Source=pt_34, Target=md_slider_3)  # -> Geometry, Transform

pt_35 = Point(flatten([Point(128, 300, 150), Point(132, 302.6892379, 150), Point(128, 305.3784759, 150), Point(132, 308.0677138, 150), Point(128, 310.7569517, 150), Point(132, 313.4461897, 150)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]))
rectangle_14 = Rectangle(Plane=PlaneXY(0, 0, 0), XSize="490", YSize="490", Radius=0)  # -> Rectangle, Length
pt_36 = Point(Point(40, 175, 0))
orient_13 = Orient(Geometry=pt_35, Source=pt_36, Target=md_slider_3)  # -> Geometry, Transform

# ----
# SEND TO 0,0,0
panel_20 = Panel("0,0,0")

panel_21 = Panel("490,490,0")
polyline_to_visual_print = PolyLine(Vertices=stream_filter, Closed=False)

panel_22 = Panel("set digital out")
number = Slider(0, range=0..10)
value = BooleanToggle(False)
digital_out = PythonScript(number=number, value=value)  # -> script; inputs number: Int32, value: Boolean
# ---------- digital_out: Python ----------
script = "def prog():\n"
script += "\ttextmsg(\">> program start\")\n"
script += "\tset_digital_out(%i, %s)\n" % (int(number), str(value))
script += "\ttextmsg(\"<< program end\")\n"
script += "end\n"
script += "prog()\n\n"

print script
# ---------- end digital_out ----------
send = Button()
send_2 = Send(script=digital_out, send=send)
panel_23 = Panel(send_2)

panel_24 = Panel("move vertical")
movel = PythonScript()  # -> script
# ---------- movel: Python ----------
from scriptcontext import sticky as st

robot = st["robot"]

tool_angle_axis = list(robot.tool.tcp_frame.point) + robot.tool.tcp_frame.axis_angle_vector
x, y, z, ax, ay, az = tool_angle_axis

script = "def prog():\n"
script += "\ttextmsg(\">> program start\")\n"
script += "\tset_tcp(p%s)\n" % str([x/1000., y/1000., z/1000, ax, ay, az])
script += "\tcurrent_pose = get_forward_kin()\n"
script += "\tmovel(p[current_pose[0], current_pose[1], current_pose[2], 0, 0, 0], a=0.1, v=0.1)\n"
script += "\ttextmsg(\"<< program end\")\n"
script += "end\n"
script += "prog()\n\n"

print script
# ---------- end movel ----------
send_3 = Button()
send_4 = Send(script=movel, send=send_3)
panel_25 = Panel(send_4)

unit_z = UnitZ(Factor=Slider(0.5, range=-10..10))
move_2 = Move(Geometry=orient_13.Geometry, Motion=unit_z)  # -> Geometry, Transform

# ----
# to INPUT
# Master Control
xy_plane_3 = XYPlane(Origin=move_2.Geometry)

# ----
# INPUT
pln_2 = Plane(flatten(xy_plane_3))

rotate_3 = Rotate(Geometry=pln_2, Angle=degrees(ur_10_tool_angle), Plane=pln_2)  # -> Geometry, Transform

# ---- group: Define commands
speed = Slider(15, range=0..300)
# SAVE POINT
safe_speed = Slider(25, range=0..300)
# 1
number_slider_12 = Slider(10, range=0..100)
planes_wcs = Plane(rotate_3.Geometry)
python = PythonScript(planes_WCS=planes_wcs, dfillet=number_slider_12, speed=speed, safe_speed=safe_speed, safe_pt=rotate_2.Geometry)  # -> commands; inputs planes_WCS: list of Plane, speed: Int32, safe_pt: Plane
# ---------- python: Python ----------
import Rhino.Geometry as rg
from compas.geometry import Frame
from compas.geometry import Transformation
from scriptcontext import sticky as st


robot = st["robot"]
buffer = 0.5

commands = []

def generate_cmds(planes_WCS, dfillet, speed, safe_speed, safe_pt):

    # add safe_pt as a starting point
    tcp_WCS_safe_pt = Frame(safe_pt.Origin, safe_pt.XAxis, safe_pt.YAxis)

    tcp_RCS_safe_pt = robot.get_frame_in_RCS(tcp_WCS_safe_pt)
    cmd_safe_pt = list(tcp_RCS_safe_pt.point) + tcp_RCS_safe_pt.axis_angle_vector + [safe_speed, 0]
    commands.append(cmd_safe_pt)


    # TODO this must be optimized! matrix multiplication!

    for i, plane_WCS in enumerate(planes_WCS):
        tcp_WCS = Frame(plane_WCS.Origin, plane_WCS.XAxis, plane_WCS.YAxis)
        if i == 0 or i == len(planes_WCS) - 1:
            radius = 0.

        else:
            # calculate blend radius
            prev, current, next = planes_WCS[i-1].Origin, planes_WCS[i].Origin, planes_WCS[i+1].Origin
            # print((prev - current).Length/2 * buffer, (next - current).Length/2 * buffer, dfillet)
            radius = min((prev - current).Length/2 * buffer, (next - current).Length/2 * buffer, dfillet)
            radius = round(radius,5)
        print(radius)
        # print()


        tcp_RCS = robot.get_frame_in_RCS(tcp_WCS)
        cmd = list(tcp_RCS.point) + tcp_RCS.axis_angle_vector + [speed, radius]
        commands.append(cmd)


    # add safe_pt as an end point
    commands.append(cmd_safe_pt)
    return commands


commands = generate_cmds(planes_WCS, dfillet, speed, safe_speed, safe_pt)

print commands[0]
# ---------- end python ----------

# ----
rotate_4 = Rotate(Geometry=xy_plane, Angle=degrees(ur_10_tool_angle), Plane=pln_2)  # -> Geometry, Transform
pln_3 = Plane(planes_wcs)

# ---- group: save_commands
py_4 = PythonScript()  # -> path
# ---------- py_4: Python ----------
import sys
import os

ghComp = ghenv.Component
ghDoc = ghComp.OnPingDocument()

# the full path of the gh file
path = ghDoc.FilePath
# the directory of the gh file
path = os.path.dirname(path)

path = os.path.abspath(os.path.join(path, ".."))

print path
# ---------- end py_4 ----------
move_filament_loading_pt = BooleanToggle(True)
continue_fabrication = BooleanToggle(True)
# 3
panel_26 = Panel(py_4)
save_json = Button()
commands = Data(python)
send_5 = PythonScript(
    path=panel_26,
    continue_fabrication=continue_fabrication,
    commands=commands,
    move_filament_loading_pt=move_filament_loading_pt,
    save_json=save_json,
    name_json="commands_group_03.json")  # -> out; inputs continue_fabrication: Int32, commands: list, move_filament_loading_pt: Boolean
# ---------- send_5: Python ----------
import json
import os

from mini_eggshell.ur_online_control.communication.msg_identifiers import *
from mini_eggshell.ur_online_control.utilities.lists import flatten_list
from time import sleep


#number of values per command to be formatted 
len_command = len(commands[0])
gh_commands = flatten_list(commands)


#to print in gh panel
print len_command, "values each command"
print len(gh_commands)/len_command, "commands." , len(gh_commands), "values"


if move_filament_loading_pt:
    print "Moving to filament loading point"
else:
    print "Skipping filament loading point"


data = {}
data['move_filament_loading_pt'] = move_filament_loading_pt
data['len_command'] = len_command
data['gh_commands'] = gh_commands


filename = os.path.join(path, name_json)
if save_json:
    with open(filename, 'w') as f:
        json.dump(data, f)
# ---------- end send_5 ----------

# ----
panel_27 = Panel(send_5)
item_8 = ListItem(List=pln_3, Index=0, Wrap=True)  # -> Item1, Item
pln_4 = Plane([item_8.Item1, item_8.Item])

# ----
# 2
# Visualisation
robot_2 = Data(robot)
pose_joints = Data(pose)
planes_wcs_2 = Plane(pln_4)

# ---- group: Calculate joint positions for path
# Add init joint states
joint_states = Data([-0.1728179112, -1.415058186, 1.813991282, -1.971940356, -1.571654205, -3.308720436])
init_configuration = Slider(2, range=0..7)
py_5 = PythonScript(robot=robot_2, planes_WCS=planes_wcs_2, configuration_idx=init_configuration, init_configuration=joint_states)  # -> configurations; inputs planes_WCS: list, configuration_idx: Int32, init_configuration: list
# ---------- py_5: Python ----------
from compas_ghpython import unload_modules
unload_modules('ur_online_control')
import Rhino.Geometry as rg
from compas.geometry import Frame 
from compas.geometry.xforms import Transformation
#from compas_ghpython import xdraw_frame
from ur_online_control.ur.kinematics import calculate_configurations_for_path, format_joint_positions


# TODO this must be optimized! matrix multiplication!
frames_tool0_RCS = []
for plane_WCS in planes_WCS:
    tcp_WCS = Frame(plane_WCS.Origin, plane_WCS.XAxis, plane_WCS.YAxis)
    tcp_RCS = robot.get_frame_in_RCS(tcp_WCS)
    frames_tool0_RCS.append(robot.get_tool0_frame_from_tcp_frame(tcp_RCS))
    

#configurations = calculate_configurations_for_path(frames_tool0_RCS, robot.params, init_configuration)
configurations = calculate_configurations_for_path(frames_tool0_RCS, robot, init_configuration)
print configurations
configurations = configurations[min([configuration_idx, len(configurations) - 1])]

def format(numbers, k=4):
    #numbers = format_joint_positions(numbers)
    return "[" + ", ".join([("%." + str(k) + "f") % n for n in numbers]) + "]"
# ---------- end py_5 ----------
start = Button()
stop_3 = Button()
step = Button()
counter = CountThroughList(L=py_5, start=start, stop=stop_3, step=step, step_back=back, reset=reset, interval=50)  # -> item; inputs L: list, start: Boolean, stop: Boolean, step_back: Boolean
# ---------- counter: Python ----------
from scriptcontext import sticky as st
from compas_ghpython import update_component


# store data in component
guid = str(ghenv.Component.InstanceGuid)
counter_key = "counter_" + guid
running_key = "running_" + guid

if counter_key not in st:
    st[counter_key] = 0

if running_key not in st:
    st[running_key] = False

if start:
    st[running_key] = True

if stop:
    st[running_key] = False

if step:
    if st[counter_key] < len(L) - 1:
        st[counter_key] += 1

if step_back:
    if st[counter_key] < len(L) - 1:
        st[counter_key] -= 1

if reset:
    st[counter_key] = 0

if len(L):
    item = L[st[counter_key]]

if st[running_key]:
    if st[counter_key] < len(L) - 1:
        st[counter_key] += 1
        update_component(ghenv, interval)
    else:
        st[counter_key] = 0
        st[running_key] = False
# ---------- end counter ----------

# ---- group: Define plane in WCS, calculate joint positions
pt_37 = Point(Point(-283.8412985, -342.877576, 297.4189147))
select_configuration = Slider(1, range=0..7)
xy_3 = XYPlane(Origin=pt_37)
plane_wcs = Plane(xy_3)
inverse = PythonScript(robot=robot_2, plane_WCS=plane_wcs, idx=select_configuration)  # -> configuration; inputs plane_WCS: Plane, idx: Int32
# ---------- inverse: Python ----------
import Rhino.Geometry as rg
from compas.geometry import Frame, Transformation
#from compas_ghpython import xdraw_frame

tcp_WCS = Frame(plane_WCS.Origin, plane_WCS.XAxis, plane_WCS.YAxis)

# transform frame to robot coordinate system
tcp_RCS = robot.get_frame_in_RCS(tcp_WCS)

# get the frame of tool0
tool0_RCS = robot.get_tool0_frame_from_tcp_frame(tcp_RCS)

# calculate solutions to frame
solutions = robot.inverse_kinematics(tool0_RCS)

if not len(solutions):
    q = [0,0,0,0,0,0]
else:
    idx = min(len(solutions) - 1, idx)
    q = solutions[idx]
    
print q

configuration = q
# ---------- end inverse ----------

# ---- group: Calculate joint positions for path / Shows joint positions along path
flip = BooleanToggle(True)
l2t = PythonScript(L=py_5, flip=flip)  # -> T; inputs L: list, flip: Boolean
# ---------- l2t: Python ----------
from compas_ghpython import list_to_ghtree
L = [l.joint_values for l in L]

if flip:
    L = zip(*L)
T = list_to_ghtree(L)
# ---------- end l2t ----------
graph_2 = QuickGraph(l2t, SortOrder=0)

# ---- group: Visualise
list_4 = ValueList({"0 forward, from angles": 0, "1 inverse, from one plane": 1, "2 inverse, from multiple planes": 2, "3 forward, from robot": 3}, selected="2 inverse, from multiple planes")
filter_2 = StreamFilter(Gate=list_4, Stream0=py_2, Stream1=inverse, Stream2=counter, Stream3=pose_joints)
configuration = Panel(filter_2)
mesh = Mesh(filter)
draw = PythonScript(robot=robot_2, configuration=filter_2, mesh=mesh, brep=filter, show_brep=show_brep)  # -> meshes, tool0_plane, tcp_plane, robot_brep; inputs mesh: list, brep: list
# ---------- draw: Python ----------
from compas_ghpython import unload_modules
unload_modules("ur_online_control")

#from compas_ghpython import xdraw_frame
from compas_ghpython import mesh_draw
from compas_ghpython.geometry.xforms import xform_from_transformation
from compas.geometry import Frame
from compas.geometry.xforms import Transformation
from mini_eggshell.ur_online_control.ur.robot import BaseConfiguration

import Rhino.Geometry as rg
import Rhino

def mesh_update_vertices(mesh, vertices):
    for i in range(len(vertices)):
        mesh.vertex[i].update({'x': vertices[i][0], 'y': vertices[i][1], 'z': vertices[i][2]})

if configuration:
    #print configuration
    #q = BaseConfiguration.from_joints(configuration)
    q = configuration
    print q
    print q.joint_values
    
    print robot.get_forward_transformations(q)
    R0, R1, R2, R3, R4, R5 = robot.get_forward_transformations(q)
    
    tool0_frame2 = robot.tool0_frame.transformed(R5)
    tcp_frame2 = Frame.from_transformation(Transformation.from_frame(tool0_frame2) * robot.transformation_tool0_tcp)
    
    print robot.transformation_tool0_tcp
    print robot.transformation_tcp_tool0
    print robot.transformation_tool0_tcp * robot.transformation_tcp_tool0
    print tcp_frame2
    tcp_frame2 = Frame.from_transformation(Transformation.from_frame(tool0_frame2) * robot.transformation_tcp_tool0)
    print tcp_frame2
    
    tool0_frame, tcp_frame = robot.get_transformed_tool_frames(R5)
    
    tool0_frame = tool0_frame2
    tcp_frame = tcp_frame2
    
    m0, m1, m2, m3, m4, m5 = mesh
    for i in range(6):
        exec("R%drg = xform_from_transformation(R%d)" % (i, i))
        exec("m%d.Transform(R%drg)" % (i, i))
    meshes = [m0, m1, m2, m3, m4, m5]
    print meshes
    mt = robot.tool.get_transformed_model(Transformation.from_frame(tool0_frame))
    
    if mt:
        meshes.extend(map(mesh_draw, mt))
    
    """
    m0, m1, m2, m3, m4, m5, tool0_frame, tcp_frame = robot.get_transformed_model(q)
    mt = robot.get_transformed_tool_model(tcp_frame)
    
    meshes = []
    meshes.append(mesh_draw(m0))
    meshes.append(mesh_draw(m1))
    meshes.append(mesh_draw(m2))
    meshes.append(mesh_draw(m3))
    meshes.append(mesh_draw(m4))
    meshes.append(mesh_draw(m5))
    if mt:
        meshes.append(mesh_draw(mt))
    
    """
    
#    tool0_plane = xdraw_frame(tool0_frame)
#    tcp_plane = xdraw_frame(tcp_frame)
    
    if show_brep:
        
        b0, b1, b2, b3, b4, b5 = brep
        
        b0.Transform(R0rg)
        b1.Transform(R1rg)
        b2.Transform(R2rg)
        b3.Transform(R3rg)
        b4.Transform(R4rg)
        b5.Transform(R5rg)
        
        robot_brep = [b0, b1, b2, b3, b4, b5]
# ---------- end draw ----------
tool0_plane = Plane(draw.tool0_plane)
tcp_plane = Plane(draw.tcp_plane)
robot_brep = Brep(draw.robot_brep)
draw_2 = RepresentPlaneAsLines(plane=tcp_plane, size=100)  # -> G, C
# ---------- draw_2: Python ----------
import Rhino.Geometry as rg
from System.Drawing import Color

if plane:

    G = []
    G.append(rg.Line(plane.Origin, size * plane.XAxis))
    G.append(rg.Line(plane.Origin, size * plane.YAxis))
    G.append(rg.Line(plane.Origin, size * plane.ZAxis))
    
    C = []
    C.append(Color.FromArgb(255, 0, 0))
    C.append(Color.FromArgb(0, 255, 0))
    C.append(Color.FromArgb(0, 0, 255))
# ---------- end draw_2 ----------
preview = CustomPreview(Geometry=draw_2.G, Shader=draw_2.C)
preview_2 = CustomPreview(Geometry=draw.meshes, Shader=ColourSwatch(SwatchColor=RGBA(99, 94, 94, 96)))

# ---- group: Send joint position directly to robot
panel_28 = Panel("move cartesian")
idx = Slider(0, range=0..100)
commands_2 = Data(python)
item_9 = ListItem(List=commands_2, Index=idx, Wrap=True)
list_5 = ValueList({"send all positions": 0, "send only one position": 1}, selected="send only one position")
filter_3 = StreamFilter(Gate=list_5, Stream0=commands_2, Stream1=item_9)
movel_2 = PythonScript(commands=filter_3, velocity=Slider(100, range=0..100))  # -> script; inputs commands: list
# ---------- movel_2: Python ----------
from scriptcontext import sticky as st

script_lines = []
for cmd in commands:
    #q, a=1.4, v=1.05, t=0, r=0)
    x, y, z, ax, ay, az, speed, radius = cmd
    script_lines.append("movel(p%s, v=%f, r=%f)" % (str([x/1000., y/1000., z/1000, ax, ay, az]), speed/1000., radius/1000.))

robot = st["robot"]
tool_angle_axis = list(robot.tool.tcp_frame.point) + robot.tool.tcp_frame.axis_angle_vector
x, y, z, ax, ay, az = tool_angle_axis

script = "def prog():\n"
script += "\ttextmsg(\">> program start\")\n"
script += "\tset_tcp(p%s)\n" % str([x/1000., y/1000., z/1000, ax, ay, az])
script += "".join(["\t%s\n" % line for line in script_lines])
script += "\ttextmsg(\"<< program end\")\n"
script += "end\n"
script += "prog()\n\n"

print script
# ---------- end movel_2 ----------
send_6 = Button()
send_7 = Send(script=movel_2, send=send_6)
panel_29 = Panel(send_7)

# ----
# move incremental in WCS
number_slider_13 = Slider(5, range=-10..10)
list_6 = ValueList({"xaxis", "yaxis", "zaxis"}, selected="zaxis")
movel_3 = PythonScript(step_size=number_slider_13, direction=list_6)  # -> script
# ---------- movel_3: Python ----------
from scriptcontext import sticky as st

robot = st["robot"]
tool_angle_axis = list(robot.tool.tcp_frame.point) + robot.tool.tcp_frame.axis_angle_vector
x, y, z, ax, ay, az = tool_angle_axis

script = "def prog():\n"
script += "\ttextmsg(\">> program start\")\n"
script += "\tset_tcp(p%s)\n" % str([x/1000., y/1000., z/1000, ax, ay, az])
script += "\tcurrent_pose = get_forward_kin()\n"


if direction == "xaxis":
    script += "\tmovel(p[current_pose[0] + %f, current_pose[1], current_pose[2], current_pose[3], current_pose[4], current_pose[5]], t=%f)\n" % (step_size/1000., step_size * 0.1)

elif direction == "yaxis":
    script += "\tmovel(p[current_pose[0], current_pose[1] + %f, current_pose[2], current_pose[3], current_pose[4], current_pose[5]], t=%f)\n" % (step_size/1000., step_size * 0.1)

else: # direction == "zaxis":
    script += "\tmovel(p[current_pose[0], current_pose[1], current_pose[2] + %f, current_pose[3], current_pose[4], current_pose[5]], t=%f)\n" % (step_size/1000., step_size * 0.1)

script += "\ttextmsg(\"<< program end\")\n"
script += "end\n"
script += "prog()\n\n"

print script
# ---------- end movel_3 ----------
send_8 = Button()
send_9 = Send(script=movel_3, send=send_8)
panel_30 = Panel(send_9)

# ----
# move incremental in TCS
get_current_pose = Button()
list_7 = ValueList({"xaxis", "yaxis", "zaxis"}, selected="zaxis")
movel_4 = PythonScript(get=get_current_pose, step_size=Slider(5, range=-10..10), direction=list_7)  # -> script; inputs get: list
# ---------- movel_4: Python ----------
from scriptcontext import sticky as st
from compas.geometry import Frame
from compas.geometry import Point, Vector
from mini_eggshell.ur_online_control.ur_direct import get_current_pose_cartesian

server_address = st["server_address"]
server_port = 30005
ur_ip = st["ur_ip"]
robot = st["robot"]
tool_angle_axis = list(robot.tool.tcp_frame.point) + robot.tool.tcp_frame.axis_angle_vector
print tool_angle_axis

guid = str(ghenv.Component.InstanceGuid)
pose_cartesian_key = "pose_cartesian" + guid

if get:
    st[pose_cartesian_key] = get_current_pose_cartesian(server_address, server_port, ur_ip, tool_angle_axis)

if pose_cartesian_key not in st:
    pose_cartesian = []
    script = ""
else:
    pose_cartesian = st[pose_cartesian_key]

    robot = st["robot"]
    tool_angle_axis = list(robot.tool.tcp_frame.point) + robot.tool.tcp_frame.axis_angle_vector
    x, y, z, ax, ay, az = tool_angle_axis
    
    script = "def prog():\n"
    script += "\ttextmsg(\">> program start\")\n"
    script += "\tset_tcp(p%s)\n" % str([x/1000., y/1000., z/1000, ax, ay, az])
    script += "\tcurrent_pose = get_forward_kin()\n"
    
#    frame = Frame.from_pose_axis_angle_vector(pose_cartesian)
    frame = Frame.from_axis_angle_vector([ax, ay, az])
    frame.point = [x, y, z]

    if direction == "xaxis":
        next_vector = Vector(*frame.xaxis) * step_size
    elif direction == "yaxis":
        next_vector = Vector(*frame.yaxis) * step_size
    else: # direction == "zaxis":
        next_vector = Vector(*frame.zaxis) * step_size
    
    x, y, z = next_vector
    script += "\tmovel(p[current_pose[0] + %f, current_pose[1] + %f, current_pose[2] + %f, current_pose[3], current_pose[4], current_pose[5]], t=%f)\n" % (x/1000., y/1000., z/1000., step_size * 0.1)
    
    script += "\ttextmsg(\"<< program end\")\n"
    script += "end\n"
    script += "prog()\n\n"
    
    print script
# ---------- end movel_4 ----------
send_10 = Button()
send_11 = Send(script=movel_4, send=send_10)
# OBJECT POSITION
# Object Visualization
# Point to bake
# Path Visualization
# Doubleclick Me!
panel_31 = Panel(send_11)

# ---- group: Send joint position directly to robot
idx_2 = Slider(0, range=0..100)
panel_32 = Panel("move joints")
joint_positions = Data(py_5)
list_8 = ValueList({"send all positions": 0, "send only one position": 1}, selected="send only one position")
item_10 = ListItem(List=joint_positions, Index=idx_2, Wrap=True)
filter_4 = StreamFilter(Gate=list_8, Stream0=joint_positions, Stream1=item_10)
movej = PythonScript(joint_positions=filter_4, velocity=Slider(153, range=0..200))  # -> script; inputs joint_positions: list
# ---------- movej: Python ----------
script_lines = []

for position in joint_positions:
    script_lines.append("movej(%s, v=%f)" % (str(position), velocity/1000.))


script = "def prog():\n"
script += "\ttextmsg(\">> program start\")\n"
script += "".join(["\t%s\n" % line for line in script_lines])
script += "\ttextmsg(\"<< program end\")\n"
script += "end\n"
script += "prog()\n\n"


print script

#script = ""
# ---------- end movej ----------
send_12 = Button()

# ----
send_13 = Send(script=movej, send=send_12)

# ---- group: Send joint position directly to robot (continued)
panel_33 = Panel(send_13)

# ==== cluster Tools

# ---- group: clay_extruder
brep = Brep([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])
yaxis_line = Curve(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)
xaxis_line = Curve(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)
test_geometry = Geometry(brep)
brep_2 = Brep(test_geometry)
mesh = Mesh(test_geometry)
tool = Tool(meshes=mesh, breps=brep_2, xline=xaxis_line, yline=yaxis_line)

# ---- group: plastic_extruder
brep_3 = Brep([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])
xaxis_line_2 = Curve(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)
yaxis_line_2 = Curve(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)
test_geometry_2 = Geometry(brep_3)
mesh_2 = Mesh(test_geometry_2)
brep_4 = Brep(test_geometry_2)
tool_2 = Tool(meshes=mesh_2, breps=brep_4, xline=xaxis_line_2, yline=yaxis_line_2)

# ---- group: clay_extruder_SS
brep_5 = Brep([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])
yaxis_line_3 = Curve(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)
xaxis_line_3 = Curve(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)
test_geometry_3 = Geometry(brep_5)
brep_6 = Brep(test_geometry_3)
mesh_3 = Mesh(test_geometry_3)
tool_3 = Tool(meshes=mesh_3, breps=brep_6, xline=xaxis_line_3, yline=yaxis_line_3)

# ----
tool_id = ClusterInput()
tool_id_2 = Integer(tool_id)
filter = StreamFilter(Gate=tool_id_2, Stream1=tool_2, Stream2=tool, Stream3=tool_3)
py = PythonScript(tool=filter)  # -> tcp_frame, model
# ---------- py: Python ----------
from compas_ghpython import mesh_draw 

tcp_frame = tool.tcp_frame
model = map(mesh_draw, tool.model)
# ---------- end py ----------
tool_4 = Data(filter)
draw = PythonScript(frame=py.tcp_frame)  # -> G, C
# ---------- draw: Python ----------
import Rhino.Geometry as rg
from System.Drawing import Color

if not size:
    size = 100

if frame:
    plane = rg.Plane(rg.Point3d(*list(frame.point)), rg.Vector3d(*list(frame.xaxis)), rg.Vector3d(*list(frame.yaxis)))

    G = []
    G.append(rg.Line(plane.Origin, size * plane.XAxis))
    G.append(rg.Line(plane.Origin, size * plane.YAxis))
    G.append(rg.Line(plane.Origin, size * plane.ZAxis))
    
    C = []
    C.append(Color.FromArgb(255, 0, 0))
    C.append(Color.FromArgb(0, 255, 0))
    C.append(Color.FromArgb(0, 0, 255))
# ---------- end draw ----------
tool_5 = ClusterOutput(tool_4)
preview = CustomPreview(Geometry=draw.G, Shader=draw.C)
preview_2 = CustomPreview(Geometry=py.model, Shader=ColourSwatch(SwatchColor=RGB(141, 170, 178)))

# ==== cluster Send
script = ClusterInput()
send = ClusterInput()
send_2 = PythonScript(script=script, send=send)  # -> out
# ---------- send_2: Python ----------
import socket
from scriptcontext import sticky as st

ur_ip = st["ur_ip"]
ur_port = 30002

if send:
    s = socket.create_connection((ur_ip, ur_port), timeout=0.5) 
    s.send(script)
    s.close()
# ---------- end send_2 ----------
out = ClusterOutput(send_2)

# ==== cluster Tool
breps = ClusterInput()
meshes = ClusterInput()
meshes_2 = Mesh(meshes)
mjoin = MeshJoin(Meshes=meshes_2)
xline = ClusterInput()
yline = ClusterInput()
tool = PythonScript(meshes=mjoin, breps=breps, xline=xline, yline=yline)  # -> tool; inputs meshes: list of Mesh, breps: list of Brep
# ---------- tool: Python ----------
import Rhino.Geometry as rg
from compas.geometry import Frame
from ur_online_control.ur.tool import Tool
from compas.datastructures import Mesh
from compas_rhino.helpers import mesh_from_guid

xaxis = rg.Line(xline.PointAtStart, xline.PointAtEnd)
yaxis = rg.Line(yline.PointAtStart, yline.PointAtEnd)

if xaxis.From.DistanceTo(yaxis.From) < 0.01:
    origin = xaxis.From
    xaxis = xaxis.Direction
    yaxis = yaxis.Direction
elif xaxis.To.DistanceTo(yaxis.To) < 0.01:
    origin = xaxis.To
    xaxis = -xaxis.Direction
    yaxis = -yaxis.Direction
elif xaxis.From.DistanceTo(yaxis.To) < 0.01:
    origin = xaxis.From
    xaxis = xaxis.Direction
    yaxis = -yaxis.Direction
elif xaxis.To.DistanceTo(yaxis.From) < 0.01:
    origin = xaxis.To
    xaxis = -xaxis.Direction
    yaxis = yaxis.Direction

xaxis.Unitize()
yaxis.Unitize()

print origin
print xaxis
print yaxis

tcp_frame = Frame(origin, xaxis, yaxis)

tool = Tool(tcp_frame)
tool.model = [mesh_from_guid(Mesh, mesh) for mesh in meshes]
#tool.model_xyz = tool.model.xyz
tool.breps = breps
# ---------- end tool ----------
tool_2 = ClusterOutput(tool)
