# Grasshopper definition 191028_ur_online_control_gh_group_04.gh (Grasshopper 1.0.7)
# plug-ins: Spirale

panel = Panel("-181 bottom extruder")
pt = Point(Point(253.2165127, 53.33895303, 0))
Z = UnitZ(Factor=Slider(-10, range=-20..10))
# -10 is good start z for print
number_slider = Slider(-175, range=-500..350)
move = Move(Geometry=pt, Motion=Z)  # -> Geometry, Transform
panel_2 = Panel("-172")
# layer height = 4
# for the mid size nozzle
panel_3 = Panel("-10")
Z_2 = UnitZ(Factor=1)
number_slider_2 = Slider(10, range=0..100)
number_slider_3 = Slider(5, range=0..100)
pt_2 = ConstructPoint(XCoordinate=Slider(0, range=-100..200), YCoordinate=number_slider, ZCoordinate=panel_3)
number_slider_4 = Slider(30, range=0..100)
geo = Geometry(<curve referenced from the Rhino model>)

# ---- group: Robot
# 0a
# Settings
# Check your IP address and set UR IP address
server_address = ValueList({"192.168.10.2", "192.168.10.11", "127.0.0.1"}, selected="192.168.10.11")
ur_ip = ValueList({"192.168.10.13", "192.168.10.11", "192.168.10.10", "127.0.0.1"}, selected="192.168.10.10")
server_port = Integer(30003)
globals = PythonScript(server_address=server_address, server_port=server_port, ur_ip=ur_ip)  # inputs server_port: Int32
# ---------- globals: Python ----------
from scriptcontext import sticky as st

st["server_address"] = server_address
st["server_port"] = server_port

st["ur_ip"] = ur_ip
# ---------- end globals ----------

# Check if UR is available
ping = Button()
py = PythonScript(ip=ur_ip, ping=ping)  # -> out
# ---------- py: Python ----------
from scriptcontext import sticky as st
from mini_eggshell.ur_online_control.ur_direct.utilities import is_available


guid = str(ghenv.Component.InstanceGuid)
txt_key = "txt_" + guid
if txt_key not in st:
    st[txt_key] = ""

if ping:
    
    available = is_available(ip)
    
    if available:
        st[txt_key] = "%s is up!" % ip
    else:
        st[txt_key] = "%s is down!" % ip

print st[txt_key]
# ---------- end py ----------
panel_4 = Panel(py)

# ----
spiral = Spirale(
    AxisStart=move.Geometry,
    AxisDirection=Z_2,
    HelixStart=Point(0, 1, 0),
    Pitch=Slider(2, range=0..10),
    TurnCount=number_slider_4,
    R1=number_slider_4,
    R2=number_slider_4)
cir = Circle(Plane=pt_2, Radius=Slider(115, range=0..150))
cir_2 = Circle(Plane=move.Geometry, Radius=number_slider_4)
range = Range(Domain=Domain(0, 1), Steps=number_slider_3)
series = Series(Start=0, Step=number_slider_2, Count=number_slider_3)
Z_3 = UnitZ(Factor=series)
area = Area(Geometry=cir_2)  # -> Area, Centroid
integer_division = IntegerDivision(A=number_slider_2, B=2)
move_2 = Move(Geometry=cir, Motion=Z_3)  # -> Geometry, Transform

# ---- group: Robot
bang = Button()
panel_5 = Panel("Unload libraries")
# 1. load robot model
# 2. set tool
# 3. set basis
unload = PythonScript(bang=bang)
# ---------- unload: Python ----------
from compas_ghpython import unload_modules

unload_modules("compas")
unload_modules("ur_online_control")
# ---------- end unload ----------

# ----
panel_6 = Panel(Z_3)
graph = GraphMapper(
    range,
    x0=0,
    x1=1,
    y0=0,
    y1=1,
    container_name="Sine",
    Equation_px=[0.06322468072, 1],
    Equation_py=[0.3642850518, 0.9405152202])
pipe = Pipe(Curve=move_2.Geometry, Radius=integer_division, Caps=1)  # -> flatten(Pipe)
rotate = Rotate(Geometry=cir_2, Angle=degrees(Slider(90, range=0..1000)), Plane=area.Centroid)  # -> Geometry, Transform
cap = CapHoles(Brep=pipe)
explode = Explode(Curve=rotate.Geometry, Recursive=True)  # -> Segments, Vertices
cull_i = CullIndex(List=graph, Indices=-1, Wrap=True)
area_2 = Area(Geometry=move_2.Geometry)  # -> Area, Centroid

# ---- group: Robot
# 1. load robot model
# 2. set tool
# 3. set basis
list = ValueList({"no_tool": 0, "plastic_extruder": 1, "clay_extruder": 2, "clay_extruder_SS": 3}, selected="clay_extruder_SS")
tools = Tools(tool_id=list)
base = PythonScript()  # -> base_frame, base
# ---------- base: Python ----------
from compas.geometry import Frame

"""
origin = [0, 0, 0]
xaxis = [1, 0, 0]
yaxis = [0, 1, 0]


origin = [-313.92, -147.58, 13.79]
xaxis = [0.00000, -1.00000, 0.00000]
yaxis = [1.00000, 0.00000, 0.00000]
"""

#axis    Y         Z                        X

origin = [122.85, -773.99, -438.31]
xaxis = [0.99984, 0.00000, -0.01771]
yaxis = [-0.00011, 0.99998, -0.00613]

base_frame = Frame(list(origin), list(xaxis), list(yaxis))

base = "base = " + str(origin) + "\n"
# ---------- end base ----------
list_2 = ValueList({"UR5", "UR10"}, selected="UR5")
robot = PythonScript(model=list_2, tool=tools, base_frame=base.base_frame)  # -> robot
# ---------- robot: Python ----------
from mini_eggshell.ur_online_control.ur.ur10 import UR10
from mini_eggshell.ur_online_control.ur.ur5 import UR5
from scriptcontext import sticky as st

if model == "UR5":
    robot = UR5()
elif model == "UR10":
    robot = UR10()

if tool:
    robot.set_tool(tool)
if base_frame:
    robot.set_base(base_frame)

st["robot"] = robot
# ---------- end robot ----------

# ---- group: mm3 to Litres
volume = Volume(Geometry=cap)  # -> Volume, Centroid
multiplication = Multiplication(A=volume.Volume, B="0.000001")
ma = MassAddition(Input=multiplication)  # -> Result, PartialResults
panel_7 = Panel(ma.Result)

# ----
crv = Curve(flatten([explode.Segments, spiral]))
join = JoinCurves(Curves=[explode.Segments, spiral], Preserve=False)
scale = Scale(Geometry=move_2.Geometry, Center=area_2.Centroid, Factor=cull_i)  # -> Geometry, Transform
panel_8 = Panel(base.base)
divdist = DivideDistance(Curve=crv, Distance=Slider(5, range=0..10))  # -> Points, Tangents, Parameters
divide = DivideCurve(Curve=crv, Count=Slider(10, range=0..100), Kinks=False)  # -> Points, Tangents, Parameters

# ---- group: Fabrication planes
pln = Plane(flatten(divdist.Points))

# ----
pt_3 = Point(Point(10, -40.6902358, -12))
number_slider_5 = Slider(0, range=0..1000)
number_slider_6 = Slider(180, range=0..360)
pt_4 = Point()
pln_2 = Plane(flatten(pln))

# ---- group: Origin
pt_5 = Point(Point(0, 0, -12))

# ---- group: Safety z offset
Z_4 = UnitZ(Factor=Slider(5, range=0..5))
move_3 = Move(Geometry=pt_5, Motion=Z_4)  # -> Geometry, Transform

# ---- group: filament_loading_pt
pt_6 = Point(Point(99.47539369, 199.2242507, 111.5438526))
xy = XYPlane(Origin=pt_6)
rotate_2 = Rotate(Geometry=xy, Angle=degrees(number_slider_6), Plane=xy)  # -> Geometry, Transform

# ----
ins = InsertItems(List=pln_2, Item=pt_6, Indices=-1, Wrap=True)
rotate_3 = Rotate(Geometry=ins, Angle=degrees(number_slider_6), Plane=ins)  # -> Geometry, Transform

# ---- group: Define commands
safe_speed = Slider(30, range=0..300)
# 1
number_slider_7 = Slider(50, range=0..100)
speed = Slider(25, range=0..300)
planes_wcs = Plane(rotate_3.Geometry)
python = PythonScript(planes_WCS=planes_wcs, dfillet=number_slider_7, speed=speed, safe_speed=safe_speed, safe_pt=rotate_2.Geometry)  # -> commands; inputs planes_WCS: list of Plane, speed: Int32, safe_pt: Plane
# ---------- python: Python ----------
import Rhino.Geometry as rg
from compas.geometry import Frame
from compas.geometry import Transformation
from scriptcontext import sticky as st


robot = st["robot"]
buffer = 0.5

commands = []

def generate_cmds(planes_WCS, dfillet, speed, safe_speed, safe_pt):

    # add safe_pt as a starting point
    tcp_WCS_safe_pt = Frame(safe_pt.Origin, safe_pt.XAxis, safe_pt.YAxis)

    tcp_RCS_safe_pt = robot.get_frame_in_RCS(tcp_WCS_safe_pt)
    cmd_safe_pt = list(tcp_RCS_safe_pt.point) + tcp_RCS_safe_pt.axis_angle_vector + [safe_speed, 0]
    commands.append(cmd_safe_pt)


    # TODO this must be optimized! matrix multiplication!

    for i, plane_WCS in enumerate(planes_WCS):
        tcp_WCS = Frame(plane_WCS.Origin, plane_WCS.XAxis, plane_WCS.YAxis)
        if i == 0 or i == len(planes_WCS) - 1:
            radius = 0.

        else:
            # calculate blend radius
            prev, current, next = planes_WCS[i-1].Origin, planes_WCS[i].Origin, planes_WCS[i+1].Origin
            # print((prev - current).Length/2 * buffer, (next - current).Length/2 * buffer, dfillet)
            radius = min((prev - current).Length/2 * buffer, (next - current).Length/2 * buffer, dfillet)
            radius = round(radius,5)
        print(radius)
        # print()


        tcp_RCS = robot.get_frame_in_RCS(tcp_WCS)
        cmd = list(tcp_RCS.point) + tcp_RCS.axis_angle_vector + [speed, radius]
        commands.append(cmd)


    # add safe_pt as an end point
    commands.append(cmd_safe_pt)
    return commands


commands = generate_cmds(planes_WCS, dfillet, speed, safe_speed, safe_pt)

print commands[0]
# ---------- end python ----------

# ---- group: test_pt
pt_7 = Point(Point(143.5449512, -50.24639294, 319.3127676))
xy_2 = XYPlane(Origin=move_3.Geometry)
rotate_4 = Rotate(Geometry=xy_2, Angle=degrees(Slider(0, range=0..1000)), Plane=xy_2)  # -> Geometry, Transform

# ----
pln_3 = Plane(planes_wcs)

# ---- group: save_commands
py_2 = PythonScript()  # -> path
# ---------- py_2: Python ----------
import sys
import os

ghComp = ghenv.Component
ghDoc = ghComp.OnPingDocument()

# the full path of the gh file
path = ghDoc.FilePath
# the directory of the gh file
path = os.path.dirname(path)

path = os.path.abspath(os.path.join(path, ".."))

print path
# ---------- end py_2 ----------
move_filament_loading_pt = BooleanToggle(True)
continue_fabrication = BooleanToggle(True)
# 3
panel_9 = Panel(py_2)
save_json = Button()
commands = Data(python)
send = PythonScript(
    path=panel_9,
    continue_fabrication=continue_fabrication,
    commands=commands,
    move_filament_loading_pt=move_filament_loading_pt,
    save_json=save_json,
    name_json="commands_group_04.json")  # -> out; inputs continue_fabrication: Int32, commands: list, move_filament_loading_pt: Boolean
# ---------- send: Python ----------
import json
import os

from mini_eggshell.ur_online_control.communication.msg_identifiers import *
from mini_eggshell.ur_online_control.utilities.lists import flatten_list
from time import sleep


#number of values per command to be formatted 
len_command = len(commands[0])
gh_commands = flatten_list(commands)


#to print in gh panel
print len_command, "values each command"
print len(gh_commands)/len_command, "commands." , len(gh_commands), "values"


if move_filament_loading_pt:
    print "Moving to filament loading point"
else:
    print "Skipping filament loading point"


data = {}
data['move_filament_loading_pt'] = move_filament_loading_pt
data['len_command'] = len_command
data['gh_commands'] = gh_commands


filename = os.path.join(path, name_json)
if save_json:
    with open(filename, 'w') as f:
        json.dump(data, f)
# ---------- end send ----------

# ----
panel_10 = Panel("python C:\Users\a\repos\mini_eggshell\ur_online_control\communication\main_direct_send_group_04.py")
panel_11 = Panel(send)
item = ListItem(List=pln_3, Index=0, Wrap=True)  # -> Item1, Item
pln_4 = Plane([item.Item1, item.Item])

# ----
# Direct UR control
get = Button()
get_2 = Button()
pose = PythonScript(get=get_2)  # -> pose_joints
# ---------- pose: Python ----------
from scriptcontext import sticky as st
from mini_eggshell.ur_online_control.ur_direct import get_current_pose_joints
from mini_eggshell.ur_online_control.ur.robot import BaseConfiguration

server_address = st["server_address"]
server_port = 30005
ur_ip = st["ur_ip"]
robot = st["robot"]
tool_angle_axis = list(robot.tool.tcp_frame.point) + list(robot.tool.tcp_frame.axis_angle_vector)
print tool_angle_axis

guid = str(ghenv.Component.InstanceGuid)
pose_joints_key = "pose_joints" + guid

if get:
    st[pose_joints_key] = get_current_pose_joints(server_address, server_port, ur_ip, tool_angle_axis)
    
if pose_joints_key not in st:
    pose_joints = []
else:
    pose_joints = BaseConfiguration.from_joints(st[pose_joints_key])
# ---------- end pose ----------
pose_2 = PythonScript(get=get)  # -> pose_cartesian
# ---------- pose_2: Python ----------
from scriptcontext import sticky as st
from mini_eggshell.ur_online_control.ur_direct import get_current_pose_cartesian

server_address = st["server_address"]
server_port = 30005
ur_ip = st["ur_ip"]
robot = st["robot"]

tool_angle_axis = list(robot.tool.tcp_frame.point) + robot.tool.tcp_frame.axis_angle_vector
print tool_angle_axis

guid = str(ghenv.Component.InstanceGuid)
pose_cartesian_key = "pose_cartesian" + guid


if get:
    st[pose_cartesian_key] = get_current_pose_cartesian(server_address, server_port, ur_ip, tool_angle_axis)

if pose_cartesian_key not in st:
    pose_cartesian = []
else:
    pose_cartesian = st[pose_cartesian_key]
# ---------- end pose_2 ----------
stop = Button()
stop_2 = PythonScript(stop=stop)
# ---------- stop_2: Python ----------
from scriptcontext import sticky as st
from mini_eggshell.ur_online_control.ur_direct import stop as stop_robot

ur_ip = st["ur_ip"]

if stop:
    stop_robot(ur_ip)
# ---------- end stop_2 ----------
panel_12 = Panel(pose_2)
panel_13 = Panel(pose)

# ----
# 2
# Visualisation
robot_2 = Data(robot)
pose_joints = Data(pose)
planes_wcs_2 = Plane(pln_4)

# ----
# 0b
vertical_pose = Number([-152.427, -780.635, 855.229, -1.1958, -1.22046, -1.20201])

# ---- group: Define plane in WCS, calculate joint positions
pt_8 = Point(Point(-283.8412985, -342.877576, 297.4189147))
select_configuration = Slider(1, range=0..7)
xy_3 = XYPlane(Origin=pt_8)
plane_wcs = Plane(xy_3)
inverse = PythonScript(robot=robot_2, plane_WCS=plane_wcs, idx=select_configuration)  # -> configuration; inputs plane_WCS: Plane, idx: Int32
# ---------- inverse: Python ----------
import Rhino.Geometry as rg
from compas.geometry import Frame, Transformation
#from compas_ghpython import xdraw_frame

tcp_WCS = Frame(plane_WCS.Origin, plane_WCS.XAxis, plane_WCS.YAxis)

# transform frame to robot coordinate system
tcp_RCS = robot.get_frame_in_RCS(tcp_WCS)

# get the frame of tool0
tool0_RCS = robot.get_tool0_frame_from_tcp_frame(tcp_RCS)

# calculate solutions to frame
solutions = robot.inverse_kinematics(tool0_RCS)

if not len(solutions):
    q = [0,0,0,0,0,0]
else:
    idx = min(len(solutions) - 1, idx)
    q = solutions[idx]
    
print q

configuration = q
# ---------- end inverse ----------

# ---- group: Origin
data = Data(["79.3845", "-766.842", "-435.007", "-0.69844", "1.52248", "0.732284"])

# ----
back = Button()
reset = Button()

# ---- group: Calculate joint positions for path
# Add init joint states
joint_states = Data([-0.1728179112, -1.415058186, 1.813991282, -1.971940356, -1.571654205, -3.308720436])
init_configuration = Slider(2, range=0..7)
py_3 = PythonScript(robot=robot_2, planes_WCS=planes_wcs_2, configuration_idx=init_configuration, init_configuration=joint_states)  # -> configurations; inputs planes_WCS: list, configuration_idx: Int32, init_configuration: list
# ---------- py_3: Python ----------
from compas_ghpython import unload_modules
unload_modules('ur_online_control')
import Rhino.Geometry as rg
from compas.geometry import Frame 
from compas.geometry.xforms import Transformation
#from compas_ghpython import xdraw_frame
from ur_online_control.ur.kinematics import calculate_configurations_for_path, format_joint_positions


# TODO this must be optimized! matrix multiplication!
frames_tool0_RCS = []
for plane_WCS in planes_WCS:
    tcp_WCS = Frame(plane_WCS.Origin, plane_WCS.XAxis, plane_WCS.YAxis)
    tcp_RCS = robot.get_frame_in_RCS(tcp_WCS)
    frames_tool0_RCS.append(robot.get_tool0_frame_from_tcp_frame(tcp_RCS))
    

#configurations = calculate_configurations_for_path(frames_tool0_RCS, robot.params, init_configuration)
configurations = calculate_configurations_for_path(frames_tool0_RCS, robot, init_configuration)
print configurations
configurations = configurations[min([configuration_idx, len(configurations) - 1])]

def format(numbers, k=4):
    #numbers = format_joint_positions(numbers)
    return "[" + ", ".join([("%." + str(k) + "f") % n for n in numbers]) + "]"
# ---------- end py_3 ----------
start = Button()
stop_3 = Button()
step = Button()
counter = CountThroughList(L=py_3, start=start, stop=stop_3, step=step, step_back=back, reset=reset, interval=50)  # -> item; inputs L: list, start: Boolean, stop: Boolean, step_back: Boolean
# ---------- counter: Python ----------
from scriptcontext import sticky as st
from compas_ghpython import update_component


# store data in component
guid = str(ghenv.Component.InstanceGuid)
counter_key = "counter_" + guid
running_key = "running_" + guid

if counter_key not in st:
    st[counter_key] = 0

if running_key not in st:
    st[running_key] = False

if start:
    st[running_key] = True

if stop:
    st[running_key] = False

if step:
    if st[counter_key] < len(L) - 1:
        st[counter_key] += 1

if step_back:
    if st[counter_key] < len(L) - 1:
        st[counter_key] -= 1

if reset:
    st[counter_key] = 0

if len(L):
    item = L[st[counter_key]]

if st[running_key]:
    if st[counter_key] < len(L) - 1:
        st[counter_key] += 1
        update_component(ghenv, interval)
    else:
        st[counter_key] = 0
        st[running_key] = False
# ---------- end counter ----------

# ---- group: Calculate joint positions for path / Shows joint positions along path
flip = BooleanToggle(True)
l2t = PythonScript(L=py_3, flip=flip)  # -> T; inputs L: list, flip: Boolean
# ---------- l2t: Python ----------
from compas_ghpython import list_to_ghtree
L = [l.joint_values for l in L]

if flip:
    L = zip(*L)
T = list_to_ghtree(L)
# ---------- end l2t ----------
graph_2 = QuickGraph(l2t, SortOrder=0)

# ---- group: Define joint positions
base_2 = Slider(90.163, range=-360..360)
shoulder = Slider(0, range=-360..360)
elbow = Slider(-102.857, range=-360..360)
wrist1 = Slider(0, range=-360..360)
wrist2 = Slider(0, range=-360..360)
wrist3 = Slider(0, range=-360..360)
ur1_q1_q6 = Data([base_2, shoulder, elbow, wrist1, wrist2, wrist3])

# ----
# Measure basis:
# 1. Clear the recorded poses
# 2. Move robot to origin and press "get pose"
# 3. Move robot to point in positive x-axis and press "get pose"
# 4. Move robot to an other point in your basis and press "get pose"
# (The farer away these positions are, the better)
# 
# 5. Alternatively change the order in the component calc base
# 6. Copy output into base component
# Calculate basis
list_3 = ValueList({"origin, pt on positive x-axis, pt in xy plane": 0, "origin, pt on positive y-axis, pt in xy plane": 1}, selected="origin, pt on positive x-axis, pt in xy plane")
clear = Button()
rec = PythonScript(msg=pose_2, rec=get, clear=clear)  # -> rec; inputs msg: list
# ---------- rec: Python ----------
from scriptcontext import sticky as st

guid = str(ghenv.Component.InstanceGuid)
recorded_key =  "recorded_" + guid
just_cleared_key = "just_cleared_" + guid

if recorded_key not in st:
    st[recorded_key] = []

if just_cleared_key not in st:
    st[just_cleared_key] = False

if clear:
    st[recorded_key] = []
    st[just_cleared_key] = True
else:
    if len(msg):
        if msg != [None] and not st[just_cleared_key] and rec:
            st[recorded_key].append(msg)
    st[just_cleared_key] = False
        


rec = st[recorded_key]

print rec
# ---------- end rec ----------
calc_base = PythonScript(poses=rec, input_type=list_3)  # -> out; inputs poses: list
# ---------- calc_base: Python ----------
import Rhino.Geometry as rg
import math


if len(poses) > 2:
    
    O = poses[0]
    P1 = poses[1]
    P2 = poses[2]
    
    if input_type == 0:
        # origin, pt on positive x-axis, pt in xy plane
        origin = rg.Point3d(O[0], O[1], O[2])
        pt_on_xaxis = rg.Point3d(P1[0], P1[1], P1[2])
        pt_in_xyplane = rg.Point3d(P2[0], P2[1], P2[2])
        
        xaxis = pt_on_xaxis - origin
        xaxis.Unitize()
        
        v = pt_in_xyplane - origin
        zaxis = rg.Vector3d.CrossProduct(v, xaxis)
        zaxis.Unitize()
        
        # zaxis must look up!
        if math.acos(rg.Vector3d.ZAxis * zaxis) > math.acos(rg.Vector3d.ZAxis * -zaxis):
            zaxis = -zaxis
        
        yaxis = rg.Vector3d.CrossProduct(zaxis, xaxis)
    
    elif input_type == 1:
        # origin, pt on positive y-axis, pt in xy plane
        origin = rg.Point3d(O[0], O[1], O[2])
        pt_on_yaxis = rg.Point3d(P1[0], P1[1], P1[2])
        pt_in_xyplane = rg.Point3d(P2[0], P2[1], P2[2])
        
        yaxis = pt_on_yaxis - origin
        yaxis.Unitize()
        
        v = pt_in_xyplane - origin
        zaxis = rg.Vector3d.CrossProduct(v, yaxis)
        zaxis.Unitize()
        
        # zaxis must look up!
        if math.acos(rg.Vector3d.ZAxis * zaxis) > math.acos(rg.Vector3d.ZAxis * -zaxis):
            zaxis = -zaxis
        
        xaxis = rg.Vector3d.CrossProduct(yaxis, zaxis)
        
        
    print "Copy the following into base component:"
    print " "
    print "origin = [%.2f, %.2f, %.2f]" % tuple(list(origin))
    print "xaxis = [%.5f, %.5f, %.5f]" % tuple(list(xaxis))
    print "yaxis = [%.5f, %.5f, %.5f]" % tuple(list(yaxis))
    

#print rg.Vector3d.CrossProduct(rg.Vector3d.YAxis, rg.Vector3d.ZAxis)
#print rg.Vector3d.CrossProduct(rg.Vector3d.ZAxis, rg.Vector3d.XAxis)
# ---------- end calc_base ----------
panel_14 = Panel(rec)
panel_15 = Panel(calc_base)

py_4 = GhPythonScript(joint_values=ur1_q1_q6)  # -> configuration; inputs joint_values: list
# ---------- py_4: Python ----------
import math
from ur_online_control.ur.robot import BaseConfiguration

configuration = BaseConfiguration.from_joints([math.radians(d) for d in joint_values])
# ---------- end py_4 ----------

# ---- group: Visualise / robot model brep
py_5 = PythonScript(model=list_2)  # -> n
# ---------- py_5: Python ----------
if model == "UR5":
    n = 0
if model == "UR10":
    n = 1

print n
# ---------- end py_5 ----------
ur10_brep = UR10Brep([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])
ur5_brep = UR5Brep([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])
show_brep = BooleanToggle(False)
filter = StreamFilter(Gate=py_5, Stream0=ur5_brep, Stream1=ur10_brep)

# ---- group: Visualise
list_4 = ValueList({"0 forward, from angles": 0, "1 inverse, from one plane": 1, "2 inverse, from multiple planes": 2, "3 forward, from robot": 3}, selected="3 forward, from robot")
filter_2 = StreamFilter(Gate=list_4, Stream0=py_4, Stream1=inverse, Stream2=counter, Stream3=pose_joints)
configuration = Panel(filter_2)
mesh = Mesh(filter)
draw = PythonScript(robot=robot_2, configuration=filter_2, mesh=mesh, brep=filter, show_brep=show_brep)  # -> meshes, tool0_plane, tcp_plane, robot_brep; inputs mesh: list, brep: list
# ---------- draw: Python ----------
from compas_ghpython import unload_modules
unload_modules("ur_online_control")

#from compas_ghpython import xdraw_frame
from compas_ghpython import mesh_draw
from compas_ghpython.geometry.xforms import xform_from_transformation
from compas.geometry import Frame
from compas.geometry.xforms import Transformation
from mini_eggshell.ur_online_control.ur.robot import BaseConfiguration

import Rhino.Geometry as rg
import Rhino

def mesh_update_vertices(mesh, vertices):
    for i in range(len(vertices)):
        mesh.vertex[i].update({'x': vertices[i][0], 'y': vertices[i][1], 'z': vertices[i][2]})

if configuration:
    #print configuration
    #q = BaseConfiguration.from_joints(configuration)
    q = configuration
    print q
    print q.joint_values
    
    print robot.get_forward_transformations(q)
    R0, R1, R2, R3, R4, R5 = robot.get_forward_transformations(q)
    
    tool0_frame2 = robot.tool0_frame.transformed(R5)
    tcp_frame2 = Frame.from_transformation(Transformation.from_frame(tool0_frame2) * robot.transformation_tool0_tcp)
    
    print robot.transformation_tool0_tcp
    print robot.transformation_tcp_tool0
    print robot.transformation_tool0_tcp * robot.transformation_tcp_tool0
    print tcp_frame2
    tcp_frame2 = Frame.from_transformation(Transformation.from_frame(tool0_frame2) * robot.transformation_tcp_tool0)
    print tcp_frame2
    
    tool0_frame, tcp_frame = robot.get_transformed_tool_frames(R5)
    
    tool0_frame = tool0_frame2
    tcp_frame = tcp_frame2
    
    m0, m1, m2, m3, m4, m5 = mesh
    for i in range(6):
        exec("R%drg = xform_from_transformation(R%d)" % (i, i))
        exec("m%d.Transform(R%drg)" % (i, i))
    meshes = [m0, m1, m2, m3, m4, m5]
    print meshes
    mt = robot.tool.get_transformed_model(Transformation.from_frame(tool0_frame))
    
    if mt:
        meshes.extend(map(mesh_draw, mt))
    
    """
    m0, m1, m2, m3, m4, m5, tool0_frame, tcp_frame = robot.get_transformed_model(q)
    mt = robot.get_transformed_tool_model(tcp_frame)
    
    meshes = []
    meshes.append(mesh_draw(m0))
    meshes.append(mesh_draw(m1))
    meshes.append(mesh_draw(m2))
    meshes.append(mesh_draw(m3))
    meshes.append(mesh_draw(m4))
    meshes.append(mesh_draw(m5))
    if mt:
        meshes.append(mesh_draw(mt))
    
    """
    
#    tool0_plane = xdraw_frame(tool0_frame)
#    tcp_plane = xdraw_frame(tcp_frame)
    
    if show_brep:
        
        b0, b1, b2, b3, b4, b5 = brep
        
        b0.Transform(R0rg)
        b1.Transform(R1rg)
        b2.Transform(R2rg)
        b3.Transform(R3rg)
        b4.Transform(R4rg)
        b5.Transform(R5rg)
        
        robot_brep = [b0, b1, b2, b3, b4, b5]
# ---------- end draw ----------
tool0_plane = Plane(draw.tool0_plane)
tcp_plane = Plane(draw.tcp_plane)
robot_brep = Brep(draw.robot_brep)
draw_2 = RepresentPlaneAsLines(plane=tcp_plane, size=100)  # -> G, C
# ---------- draw_2: Python ----------
import Rhino.Geometry as rg
from System.Drawing import Color

if plane:

    G = []
    G.append(rg.Line(plane.Origin, size * plane.XAxis))
    G.append(rg.Line(plane.Origin, size * plane.YAxis))
    G.append(rg.Line(plane.Origin, size * plane.ZAxis))
    
    C = []
    C.append(Color.FromArgb(255, 0, 0))
    C.append(Color.FromArgb(0, 255, 0))
    C.append(Color.FromArgb(0, 0, 255))
# ---------- end draw_2 ----------
preview = CustomPreview(Geometry=draw_2.G, Shader=draw_2.C)
preview_2 = CustomPreview(Geometry=draw.meshes, Shader=ColourSwatch(SwatchColor=RGBA(99, 94, 94, 96)))

# ---- group: Send joint position directly to robot
panel_16 = Panel("move cartesian")
idx = Slider(0, range=0..100)
commands_2 = Data(python)
item_2 = ListItem(List=commands_2, Index=idx, Wrap=True)
list_5 = ValueList({"send all positions": 0, "send only one position": 1}, selected="send only one position")
filter_3 = StreamFilter(Gate=list_5, Stream0=commands_2, Stream1=item_2)
movel = PythonScript(commands=filter_3, velocity=Slider(100, range=0..100))  # -> script; inputs commands: list
# ---------- movel: Python ----------
from scriptcontext import sticky as st

script_lines = []
for cmd in commands:
    #q, a=1.4, v=1.05, t=0, r=0)
    x, y, z, ax, ay, az, speed, radius = cmd
    script_lines.append("movel(p%s, v=%f, r=%f)" % (str([x/1000., y/1000., z/1000, ax, ay, az]), speed/1000., radius/1000.))

robot = st["robot"]
tool_angle_axis = list(robot.tool.tcp_frame.point) + robot.tool.tcp_frame.axis_angle_vector
x, y, z, ax, ay, az = tool_angle_axis

script = "def prog():\n"
script += "\ttextmsg(\">> program start\")\n"
script += "\tset_tcp(p%s)\n" % str([x/1000., y/1000., z/1000, ax, ay, az])
script += "".join(["\t%s\n" % line for line in script_lines])
script += "\ttextmsg(\"<< program end\")\n"
script += "end\n"
script += "prog()\n\n"

print script
# ---------- end movel ----------
send_2 = Button()
send_3 = Send(script=movel, send=send_2)
panel_17 = Panel(send_3)

# ----
panel_18 = Panel("set digital out")
number = Slider(0, range=0..10)
value = BooleanToggle(False)
digital_out = PythonScript(number=number, value=value)  # -> script; inputs number: Int32, value: Boolean
# ---------- digital_out: Python ----------
script = "def prog():\n"
script += "\ttextmsg(\">> program start\")\n"
script += "\tset_digital_out(%i, %s)\n" % (int(number), str(value))
script += "\ttextmsg(\"<< program end\")\n"
script += "end\n"
script += "prog()\n\n"

print script
# ---------- end digital_out ----------
send_4 = Button()
send_5 = Send(script=digital_out, send=send_4)
panel_19 = Panel(send_5)

panel_20 = Panel("move vertical")
movel_2 = PythonScript()  # -> script
# ---------- movel_2: Python ----------
from scriptcontext import sticky as st

robot = st["robot"]

tool_angle_axis = list(robot.tool.tcp_frame.point) + robot.tool.tcp_frame.axis_angle_vector
x, y, z, ax, ay, az = tool_angle_axis

script = "def prog():\n"
script += "\ttextmsg(\">> program start\")\n"
script += "\tset_tcp(p%s)\n" % str([x/1000., y/1000., z/1000, ax, ay, az])
script += "\tcurrent_pose = get_forward_kin()\n"
script += "\tmovel(p[current_pose[0], current_pose[1], current_pose[2], 0, 0, 0], a=0.1, v=0.1)\n"
script += "\ttextmsg(\"<< program end\")\n"
script += "end\n"
script += "prog()\n\n"

print script
# ---------- end movel_2 ----------
send_6 = Button()
send_7 = Send(script=movel_2, send=send_6)
panel_21 = Panel(send_7)

# ----
# move incremental in WCS
number_slider_8 = Slider(5, range=-10..10)
list_6 = ValueList({"xaxis", "yaxis", "zaxis"}, selected="zaxis")
movel_3 = PythonScript(step_size=number_slider_8, direction=list_6)  # -> script
# ---------- movel_3: Python ----------
from scriptcontext import sticky as st

robot = st["robot"]
tool_angle_axis = list(robot.tool.tcp_frame.point) + robot.tool.tcp_frame.axis_angle_vector
x, y, z, ax, ay, az = tool_angle_axis

script = "def prog():\n"
script += "\ttextmsg(\">> program start\")\n"
script += "\tset_tcp(p%s)\n" % str([x/1000., y/1000., z/1000, ax, ay, az])
script += "\tcurrent_pose = get_forward_kin()\n"


if direction == "xaxis":
    script += "\tmovel(p[current_pose[0] + %f, current_pose[1], current_pose[2], current_pose[3], current_pose[4], current_pose[5]], t=%f)\n" % (step_size/1000., step_size * 0.1)

elif direction == "yaxis":
    script += "\tmovel(p[current_pose[0], current_pose[1] + %f, current_pose[2], current_pose[3], current_pose[4], current_pose[5]], t=%f)\n" % (step_size/1000., step_size * 0.1)

else: # direction == "zaxis":
    script += "\tmovel(p[current_pose[0], current_pose[1], current_pose[2] + %f, current_pose[3], current_pose[4], current_pose[5]], t=%f)\n" % (step_size/1000., step_size * 0.1)

script += "\ttextmsg(\"<< program end\")\n"
script += "end\n"
script += "prog()\n\n"

print script
# ---------- end movel_3 ----------
send_8 = Button()
send_9 = Send(script=movel_3, send=send_8)
panel_22 = Panel(send_9)

# ----
# move incremental in TCS
get_current_pose = Button()
list_7 = ValueList({"xaxis", "yaxis", "zaxis"}, selected="zaxis")
movel_4 = PythonScript(get=get_current_pose, step_size=Slider(5, range=-10..10), direction=list_7)  # -> script; inputs get: list
# ---------- movel_4: Python ----------
from scriptcontext import sticky as st
from compas.geometry import Frame
from compas.geometry import Point, Vector
from mini_eggshell.ur_online_control.ur_direct import get_current_pose_cartesian

server_address = st["server_address"]
server_port = 30005
ur_ip = st["ur_ip"]
robot = st["robot"]
tool_angle_axis = list(robot.tool.tcp_frame.point) + robot.tool.tcp_frame.axis_angle_vector
print tool_angle_axis

guid = str(ghenv.Component.InstanceGuid)
pose_cartesian_key = "pose_cartesian" + guid

if get:
    st[pose_cartesian_key] = get_current_pose_cartesian(server_address, server_port, ur_ip, tool_angle_axis)

if pose_cartesian_key not in st:
    pose_cartesian = []
    script = ""
else:
    pose_cartesian = st[pose_cartesian_key]

    robot = st["robot"]
    tool_angle_axis = list(robot.tool.tcp_frame.point) + robot.tool.tcp_frame.axis_angle_vector
    x, y, z, ax, ay, az = tool_angle_axis
    
    script = "def prog():\n"
    script += "\ttextmsg(\">> program start\")\n"
    script += "\tset_tcp(p%s)\n" % str([x/1000., y/1000., z/1000, ax, ay, az])
    script += "\tcurrent_pose = get_forward_kin()\n"
    
#    frame = Frame.from_pose_axis_angle_vector(pose_cartesian)
    frame = Frame.from_axis_angle_vector([ax, ay, az])
    frame.point = [x, y, z]

    if direction == "xaxis":
        next_vector = Vector(*frame.xaxis) * step_size
    elif direction == "yaxis":
        next_vector = Vector(*frame.yaxis) * step_size
    else: # direction == "zaxis":
        next_vector = Vector(*frame.zaxis) * step_size
    
    x, y, z = next_vector
    script += "\tmovel(p[current_pose[0] + %f, current_pose[1] + %f, current_pose[2] + %f, current_pose[3], current_pose[4], current_pose[5]], t=%f)\n" % (x/1000., y/1000., z/1000., step_size * 0.1)
    
    script += "\ttextmsg(\"<< program end\")\n"
    script += "end\n"
    script += "prog()\n\n"
    
    print script
# ---------- end movel_4 ----------
send_10 = Button()
send_11 = Send(script=movel_4, send=send_10)
panel_23 = Panel(send_11)

# ---- group: Send joint position directly to robot
idx_2 = Slider(0, range=0..100)
panel_24 = Panel("move joints")
joint_positions = Data(py_3)
list_8 = ValueList({"send all positions": 0, "send only one position": 1}, selected="send only one position")
item_3 = ListItem(List=joint_positions, Index=idx_2, Wrap=True)
filter_4 = StreamFilter(Gate=list_8, Stream0=joint_positions, Stream1=item_3)
movej = PythonScript(joint_positions=filter_4, velocity=Slider(153, range=0..200))  # -> script; inputs joint_positions: list
# ---------- movej: Python ----------
script_lines = []

for position in joint_positions:
    script_lines.append("movej(%s, v=%f)" % (str(position), velocity/1000.))


script = "def prog():\n"
script += "\ttextmsg(\">> program start\")\n"
script += "".join(["\t%s\n" % line for line in script_lines])
script += "\ttextmsg(\"<< program end\")\n"
script += "end\n"
script += "prog()\n\n"


print script

#script = ""
# ---------- end movej ----------
send_12 = Button()

# ----
send_13 = Send(script=movej, send=send_12)

# ---- group: Send joint position directly to robot (continued)
panel_25 = Panel(send_13)

# ==== cluster Tools

# ---- group: clay_extruder
brep = Brep([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])
yaxis_line = Curve(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)
xaxis_line = Curve(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)
test_geometry = Geometry(brep)
brep_2 = Brep(test_geometry)
mesh = Mesh(test_geometry)
tool = Tool(meshes=mesh, breps=brep_2, xline=xaxis_line, yline=yaxis_line)

# ---- group: plastic_extruder
brep_3 = Brep([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])
xaxis_line_2 = Curve(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)
yaxis_line_2 = Curve(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)
test_geometry_2 = Geometry(brep_3)
mesh_2 = Mesh(test_geometry_2)
brep_4 = Brep(test_geometry_2)
tool_2 = Tool(meshes=mesh_2, breps=brep_4, xline=xaxis_line_2, yline=yaxis_line_2)

# ---- group: clay_extruder_SS
brep_5 = Brep([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])
yaxis_line_3 = Curve(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)
xaxis_line_3 = Curve(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)
test_geometry_3 = Geometry(brep_5)
brep_6 = Brep(test_geometry_3)
mesh_3 = Mesh(test_geometry_3)
tool_3 = Tool(meshes=mesh_3, breps=brep_6, xline=xaxis_line_3, yline=yaxis_line_3)

# ----
tool_id = ClusterInput()
tool_id_2 = Integer(tool_id)
filter = StreamFilter(Gate=tool_id_2, Stream1=tool_2, Stream2=tool, Stream3=tool_3)
py = PythonScript(tool=filter)  # -> tcp_frame, model
# ---------- py: Python ----------
from compas_ghpython import mesh_draw 

tcp_frame = tool.tcp_frame
model = map(mesh_draw, tool.model)
# ---------- end py ----------
tool_4 = Data(filter)
draw = PythonScript(frame=py.tcp_frame)  # -> G, C
# ---------- draw: Python ----------
import Rhino.Geometry as rg
from System.Drawing import Color

if not size:
    size = 100

if frame:
    plane = rg.Plane(rg.Point3d(*list(frame.point)), rg.Vector3d(*list(frame.xaxis)), rg.Vector3d(*list(frame.yaxis)))

    G = []
    G.append(rg.Line(plane.Origin, size * plane.XAxis))
    G.append(rg.Line(plane.Origin, size * plane.YAxis))
    G.append(rg.Line(plane.Origin, size * plane.ZAxis))
    
    C = []
    C.append(Color.FromArgb(255, 0, 0))
    C.append(Color.FromArgb(0, 255, 0))
    C.append(Color.FromArgb(0, 0, 255))
# ---------- end draw ----------
tool_5 = ClusterOutput(tool_4)
preview = CustomPreview(Geometry=draw.G, Shader=draw.C)
preview_2 = CustomPreview(Geometry=py.model, Shader=ColourSwatch(SwatchColor=RGB(141, 170, 178)))

# ==== cluster Send
script = ClusterInput()
send = ClusterInput()
send_2 = PythonScript(script=script, send=send)  # -> out
# ---------- send_2: Python ----------
import socket
from scriptcontext import sticky as st

ur_ip = st['ur_ip']
ur_port = 30002

if send:
    s = socket.create_connection((ur_ip, ur_port), timeout=0.5) 
    s.send(script)
    s.close()
# ---------- end send_2 ----------
out = ClusterOutput(send_2)

# ==== cluster Tool
breps = ClusterInput()
meshes = ClusterInput()
meshes_2 = Mesh(meshes)
mjoin = MeshJoin(Meshes=meshes_2)
xline = ClusterInput()
yline = ClusterInput()
tool = PythonScript(meshes=mjoin, breps=breps, xline=xline, yline=yline)  # -> tool; inputs meshes: list of Mesh, breps: list of Brep
# ---------- tool: Python ----------
import Rhino.Geometry as rg
from compas.geometry import Frame
from ur_online_control.ur.tool import Tool
from compas.datastructures import Mesh
from compas_rhino.helpers import mesh_from_guid

xaxis = rg.Line(xline.PointAtStart, xline.PointAtEnd)
yaxis = rg.Line(yline.PointAtStart, yline.PointAtEnd)

if xaxis.From.DistanceTo(yaxis.From) < 0.01:
    origin = xaxis.From
    xaxis = xaxis.Direction
    yaxis = yaxis.Direction
elif xaxis.To.DistanceTo(yaxis.To) < 0.01:
    origin = xaxis.To
    xaxis = -xaxis.Direction
    yaxis = -yaxis.Direction
elif xaxis.From.DistanceTo(yaxis.To) < 0.01:
    origin = xaxis.From
    xaxis = xaxis.Direction
    yaxis = -yaxis.Direction
elif xaxis.To.DistanceTo(yaxis.From) < 0.01:
    origin = xaxis.To
    xaxis = -xaxis.Direction
    yaxis = yaxis.Direction

xaxis.Unitize()
yaxis.Unitize()

print origin
print xaxis
print yaxis

tcp_frame = Frame(origin, xaxis, yaxis)

tool = Tool(tcp_frame)
tool.model = [mesh_from_guid(Mesh, mesh) for mesh in meshes]
#tool.model_xyz = tool.model.xyz
tool.breps = breps
# ---------- end tool ----------
tool_2 = ClusterOutput(tool)
